# Grasshopper definition architecture2MultipleSystemsTest.gh (Grasshopper 0.9.75)
# plug-ins: Agent

number_slider = Slider(15, range=0..100)
box = DomainBox(Base=PlaneXY(0, 0, 0), X=number_slider, Y=number_slider, Z=number_slider)
crv = Curve(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)
wires = BrepWireframe(Brep=box, Density=-1)
crvemit = CurveEmitter(Curve=crv, ContinuousFlow=True, CreationRate=1, NumberOfAgents=0)
agent = ConstructAgent(
    Lifespan=Slider(100, range=0..100),
    Mass=1,
    BodySize=1,
    MaxSpeed=0.5,
    MaxForce=0.1,
    VisionAngle=15,
    VisionRadius=5,
    HistoryLength=Slider(5, range=0..10))
system = System(Agents=agent, Emitters=crvemit)
boxemit = BoxEmitter(Box=box, ContinuousFlow=True, CreationRate=1, NumberOfAgents=0)
timer = Timer(TimerInterval=20, Target=[engine, system_2, system])  # disabled
system_2 = System(Agents=agent, Emitters=boxemit)
number_slider_2 = Slider(360, range=0..1000)
deconstructsystem = DeconstructSystem(System=system_2)  # -> Agents, AgentCollection
deconstructsystem_2 = DeconstructSystem(System=system)  # -> Agents, AgentCollection
engine = Engine(Reset=Toggle(False), System=[system_2, system])
aaboxenv = AxisAlignedBoxEnvironment(Box=box)
neighbors = GetNeighborsInRadius(
    Agent=deconstructsystem.Agents,
    AgentCollection=deconstructsystem.AgentCollection,
    VisionRadius=5,
    VisionAngle=number_slider_2)
followpath = FollowPathForce(Agent=deconstructsystem.Agents, WeightMultiplier=1, Curve=crv, PathRadius=5, PredictionDistance=5, PathTargetDistance=5)
neighbors_2 = GetNeighborsInRadius(
    Agent=deconstructsystem.Agents,
    AgentCollection=neighbors,
    VisionRadius=Slider(3.333, range=0..10),
    VisionAngle=number_slider_2)
neighbors_3 = GetNeighborsInRadius(
    Agent=deconstructsystem.Agents,
    AgentCollection=neighbors_2,
    VisionRadius=Slider(1, range=0..1),
    VisionAngle=number_slider_2)
neighbors_4 = GetNeighborsInRadius(
    Agent=deconstructsystem_2.Agents,
    AgentCollection=deconstructsystem.AgentCollection,
    VisionRadius=5,
    VisionAngle=number_slider_2)
deconstructagent = DeconstructAgent(Agent=deconstructsystem.Agents)  # -> Position, Velocity, Acceleration, Lifespan, PositionHistory
cohese = CoheseForce(Agent=deconstructsystem.Agents, GetNeighborsInRadius=neighbors, WeightMultiplier=1)
align = AlignForce(Agent=deconstructsystem.Agents, GetNeighborsInRadius=neighbors_3, WeightMultiplier=1)
separate = SeparateForce(Agent=deconstructsystem.Agents, GetNeighborsInRadius=neighbors_3, WeightMultiplier=1)
deconstructagent_2 = DeconstructAgent(Agent=deconstructsystem_2.Agents)  # -> Position, Velocity, Acceleration, Lifespan, PositionHistory
separate_2 = SeparateForce(Agent=deconstructsystem_2.Agents, GetNeighborsInRadius=neighbors_4, WeightMultiplier=1)
bouncecontain = BounceContainBehavior(System=system, Environment=aaboxenv)
contain = ContainForce(Agent=deconstructsystem_2.Agents, Environment=aaboxenv, WeightMultiplier=1, VisionRadius=5)
intcrv = Interpolate(Vertices=deconstructagent_2.PositionHistory, Degree=3, Periodic=False, KnotStyle=1)  # -> Curve, Length, Domain
intcrv_2 = Interpolate(Vertices=deconstructagent.PositionHistory, Degree=3, Periodic=False, KnotStyle=1)  # -> Curve, Length, Domain
swatch = ColourSwatch(SwatchColor=RGB(255, 0, 120))
swatch_2 = ColourSwatch(SwatchColor=RGB(0, 255, 255))
vdisex = VectorDisplayEx(Point=deconstructagent_2.Position, Vector=deconstructagent_2.Velocity, Colour=swatch_2, Width=Slider(1, range=0..10))
vdisex_2 = VectorDisplayEx(Point=deconstructagent.Position, Vector=deconstructagent.Velocity, Colour=swatch, Width=Slider(1, range=0..10))
preview = CustomPreview(Geometry=intcrv.Curve, Shader=swatch_2)
preview_2 = CustomPreview(Geometry=intcrv_2.Curve, Shader=swatch)
