# Grasshopper definition attractTest.gh (Grasshopper 0.9.75)
# plug-ins: Agent

number_slider = Slider(100, range=0..100)
dom = ConstructDomain(DomainStart=0, DomainEnd=Slider(0.1, range=0..1))
domain = Domain()
random = Random(Range=dom, Number=number_slider, Seed=0)
random_2 = Random(Range=dom, Number=number_slider, Seed=1)
random_3 = Random(Range=dom, Number=number_slider, Seed=2)
crv = Curve(<curve referenced from the Rhino model>)
vec = VectorXYZ(XComponent=random, YComponent=random_2, ZComponent=random_3)  # -> Vector, Length
crvemit = CurveEmitter(Curve=crv, ContinuousFlow=True, CreationRate=1, NumberOfAgents=0)
agent = ConstructAgent(
    Lifespan=Slider(100, range=0..1000),
    Mass=1,
    BodySize=1,
    MaxSpeed=0.5,
    MaxForce=Slider(0.1, range=0..1),
    VisionAngle=15,
    VisionRadius=5,
    HistoryLength=Slider(5, range=0..10),
    InitialVelocity=vec.Vector)
ptemit = PointEmitter(Point=Point(0, 0, 0), ContinuousFlow=True, CreationRate=1, NumberOfAgents=0)
number_slider_2 = Slider(-1, range=-1..1)
pt = ConstructPoint(XCoordinate=0, YCoordinate=0, ZCoordinate=0)
pt_2 = Point(<point referenced from the Rhino model>)
system = System(Agents=agent, Emitters=crvemit)
deconstructsystem = DeconstructSystem(System=system)  # -> Agents, AgentCollection
attract = AttractionForce(Agent=deconstructsystem.Agents, Point=pt_2, WeightMultiplier=Slider(-5, range=-10..10), AttractionRadius=5)
timer = Timer(TimerInterval=20, Target=[engine, system])  # disabled
engine = Engine(Reset=Toggle(False), System=system)
deconstructagent = DeconstructAgent(Agent=deconstructsystem.Agents)  # -> Position, Velocity, Acceleration, Lifespan, PositionHistory
vdis = VectorDisplay(Anchor=deconstructagent.Position)
intcrv = Interpolate(Vertices=deconstructagent.PositionHistory, Degree=3, Periodic=False, KnotStyle=1)  # -> Curve, Length, Domain
