# Grasshopper definition braitenbergOnSurface.gh (Grasshopper 0.9.75)
# plug-ins: Agent

# ---- group: Pre-Loaded Values
min = Panel("466000.0")
max = Panel("1259000.0")
solar_exposure_values = Panel("""1172436.75
1047414.5
1001287.875
1011595.25
1054090.75
1104832.0
1147844.5
1114301.25
1004563.25
1011193.75
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""")
solarexposurevalues = Number(solar_exposure_values)
min_2 = Number(min)
max_2 = Number(max)

# ----
inputsrf = Surface(<surface referenced from the Rhino model>)  # disabled

# ---- group: inputs
inputsrf_2 = Surface(<surface referenced from the Rhino model>)

# ----
U = UCount(31)
V = VCount(7)
srfenv = SurfaceEnvironment(Surface=inputsrf_2)  # -> Environment, _2DReferenceSurface
divide = DivideDomain²(Domain=inputsrf_2, UCount=U, VCount=V)
crv = Curve([<curve referenced from the Rhino model> x15])  # disabled
gradient = Gradient(LowerLimit=min_2, UpperLimit=max_2, Parameter=solarexposurevalues, stops=[0: RGB(255, 255, 255), 1: RGB(0, 0, 0)])
gradient_2 = Gradient(
    LowerLimit=min_2,
    UpperLimit=max_2,
    Parameter=solarexposurevalues,
    stops=[0: RGB(75, 107, 169), 0.329: RGB(254, 244, 84), 0.655: RGB(234, 126, 0), 1: RGB(234, 38, 0)])
subsrf = Isotrim(Surface=inputsrf, Domain=divide)
subsrf_2 = Isotrim(Surface=inputsrf_2, Domain=divide)
dim = Dimensions(Surface=srfenv._2DReferenceSurface)  # -> UDimension, VDimension; disabled
subsrf_3 = Isotrim(Surface=srfenv._2DReferenceSurface, Domain=divide)
divide_2 = DivideCurve(Curve=crv, Count=Slider(50, range=0..100), Kinks=False)  # -> Points, Tangents, Parameters
sbox = SurfaceBox(Surface=subsrf, Domain=divide, Height=Slider(8, range=0..100))
sdivide = DivideSurface(Surface=reparameterize(srfenv._2DReferenceSurface), UCount=dim.UDimension, VCount=dim.VDimension)  # -> Points, Normals, simplify(Parameters)
srf_cp = SurfaceClosestPoint(Point=divide_2.Points, Surface=inputsrf)  # -> Point, UVPoint, Distance
debrep = DeconstructBrep(Brep=sbox)  # -> Faces, Edges, Vertices
inputsrf_3 = Surface(inputsrf_2)
intcrv = Interpolate(Vertices=srf_cp.Point, Degree=3, Periodic=True, KnotStyle=1)  # -> flatten(Curve), Length, Domain
srf = Surface(debrep.Faces)
brep = Brep(<brep referenced from the Rhino model>)
image = ImageSampler(
    simplify(sdivide.Parameters),
    FilePath="E:\OneDrive\Documents\cmu\11-Fall_2014\Thesis\Demos\ecoSkinBitmapBlurredSmall.jpg",
    Filter="Colour",
    Interpolate=False,
    Umax=1,
    Umin=0,
    Vmax=1,
    Vmin=0,
    Wrap=1)
preview = CustomPreview(Geometry=subsrf_2, Shader=gradient)
preview_2 = CustomPreview(Geometry=subsrf_3, Shader=gradient)
edges = BrepEdges(Brep=srfenv._2DReferenceSurface)  # -> Naked, Interior, NonManifold
edges_2 = BrepEdges(Brep=inputsrf_2)  # -> Naked, Interior, NonManifold
pipe = Pipe(Curve=intcrv.Curve, Radius=Slider(12, range=0..100), Caps=0)  # disabled
join = BrepJoin(Breps=srf)  # -> flatten(Breps), Closed
item = ListItem(List=edges.Naked, Index=1, Wrap=True)
item_2 = ListItem(List=edges.Naked, Index=3, Wrap=True)
lng = ListLength(List=join.Breps)
divide_3 = DivideCurve(Curve=[item_2, item], Count=Slider(16, range=0..100), Kinks=False)  # -> Points, Tangents, Parameters
division = Division(A=lng, B=Slider(15, range=0..100))
partition = PartitionList(List=join.Breps, Size=division)
shift = ShiftList(List=divide_3.Points, Shift=1, Wrap=False)
shift_2 = ShiftList(List=shift, Shift=-1, Wrap=False)
sdiff = SolidDifference(BrepsA=brep, BrepsB=flatten(pipe))  # disabled
branch = Branch_2(data=partition, i=Slider(0, range=0..10))
srf_cp_2 = SurfaceClosestPoint(Point=shift_2, Surface=srfenv._2DReferenceSurface)  # -> Point, UVPoint, Distance
preview_3 = CustomPreview(Geometry=simplify(sdivide.Points), Shader=image)
evalsrf = EvaluateSurface(Surface=inputsrf_2, Point=srf_cp_2.UVPoint)  # -> simplify(Point), Normal, Frame
branch_2 = Branch_2(data=shift_2, i=Slider(1, range=0..100))
branch_3 = Branch(data=evalsrf.Frame, i=Slider(0, range=0..100))
deplane = DeconstructPlane(Plane=branch_3)  # -> Origin, XAxis, YAxis, ZAxis
rev = ReverseList(List=branch_2)
amp = Amplitude(Vector=deplane.XAxis, Amplitude=Slider(0.36, range=0..1))
amp_2 = Amplitude(Vector=deplane.XAxis, Amplitude=0.001)  # -> simplify(Vector)
particle = ConstructParticle(
    MinimumInitialVelocity=amp,
    MaximumInitialVelocity=amp,
    Acceleration=Vector(0, 0, 0),
    Lifespan=Slider(-1, range=-1..1000),
    Mass=1,
    BodySize=1,
    HistoryLength=Slider(1000, range=0..1000))
move = Move(Geometry=branch_3, Motion=expr("-x", amp_2))  # -> Geometry, Transform
move_2 = Move(Geometry=branch_3, Motion=amp_2)  # -> Geometry, Transform
agent = ConstructAgent(Particle=particle, MaxSpeed=0.5, MaxForce=0.1, VisionRadius=5, VisionAngle=360)
vehicle = ConstructVehicle(Agent=agent, Orientation=PlaneXY(0, 0, 0), WheelRadius=Slider(1, range=0..1))
ptemit = PointEmitter(
    ContinuousFlow=Toggle(False),
    CreationRate=Slider(5, range=0..10),
    NumberOfQuelea=Slider(1, range=0..10),
    Point=move_2.Geometry)
timer = Timer(TimerInterval=20, Target=[engine, system])  # disabled
system = System(Quelea=vehicle, Emitters=ptemit, Environment=srfenv.Environment)
desystem = DeconstructSystem(System=system)  # -> Quelea, QueleaNetwork
engine = Engine(Reset=Toggle(False), System=system)
devehicle = DeconstructVehicle(Vehicle=desystem.Quelea)  # -> Orientation, simplify(WheelPositions), WheelTangentialVelocity, WheelAngles, WheelRadii, WheelAngularVelocity
departicle = DeconstructParticle(Particle=desystem.Quelea)  # -> simplify(Position), Velocity, Acceleration, Lifespan, Mass, BodySize, ReferencePosition, SurfaceVelocity, SurfaceAcceleration
contain = ContainForce(Apply=True, Agent=desystem.Quelea, WeightMultiplier=1, VisionRadius=1)
panel = Panel("E:\OneDrive\Documents\cmu\11-Fall_2014\Thesis\Demos\ecoSkinBitmapBlurredSmall.jpg")
pline = PolyLine(Vertices=departicle.Position, Closed=False)  # -> flatten(Polyline)
item_3 = ListItem(List=departicle.Position, Index=0, Wrap=True)  # -> flatten(Item)
pt = Point(departicle.ReferencePosition)
vdis = VectorDisplay(Anchor=pt, Vector=departicle.SurfaceVelocity)
vdis_2 = VectorDisplay(Anchor=item_3, Vector=departicle.Velocity)
number_slider = Slider(10, range=0..10)  # disabled
len = Length(Curve=pline)
image_2 = LoadImage(Filepath=panel, Reload=False)
pt_2 = Point(<point referenced from the Rhino model>)  # disabled
divide_4 = DivideCurve(Curve=pline, Count=len, Kinks=False)  # -> Points, Tangents, Parameters
pt_3 = Point(move.Geometry)

crv_2 = Curve(<curve referenced from the Rhino model>)
number_slider_2 = Slider(10, range=0..100)
incurve = PointInCurve(Point=departicle.ReferencePosition, Curve=crv_2)  # -> Relationship, Point
number_slider_3 = Slider(0.12, range=0..1)
dom = ConstructDomain(DomainStart=number_slider_3, DomainEnd=1)
dist = Distance(PointA=departicle.ReferencePosition, PointB=rev)
dom_2 = ConstructDomain(DomainStart=number_slider_2, DomainEnd=0)
bool = Boolean(incurve.Relationship)
remap = RemapNumbers(Value=dist, Source=dom_2, Target=dom)  # -> Mapped, Clipped
not = GateNot(A=bool)
switch = CSharpScript(within=bool, low=number_slider_3, high=remap.Mapped)  # -> out, W; inputs within: Boolean, low: Double, high: Double
# ---------- switch: C# ----------
    double weight = low;
    if(within) {
      weight = high;
    }
    W = weight;
# ---------- end switch ----------
seek = SeekForce(Apply=True, Agent=desystem.Quelea, WeightMultiplier=switch.W, TargetPoint=pt_3)

attract = AttractForce(
    Apply=not,
    Particle=desystem.Quelea,
    WeightMultiplier=1,
    TargetPoint=pt_2,
    Mass=number_slider,
    DistanceLowerLimit=5,
    DistanceUpperLimit=100)  # disabled
sensefield = SensoryFieldForce(Apply=not, Vehicle=desystem.Quelea, WeightMultiplier=1, BitmapImage=image_2, Crossed=False)  # -> Force, SL, SR
srf_cp_3 = SurfaceClosestPoint(Point=divide_4.Points, Surface=reparameterize(inputsrf_2))  # -> Point, UVPoint, Distance
evalsrf_2 = EvaluateSurface(Surface=reparameterize(srfenv._2DReferenceSurface), Point=srf_cp_3.UVPoint)  # -> Point, Normal, Frame
swatch = ColourSwatch(SwatchColor=RGB(0, 255, 255))
pline_2 = PolyLine(Vertices=evalsrf_2.Point, Closed=False)
preview_4 = CustomPreview(Geometry=pline, Shader=swatch)
preview_5 = CustomPreview(Geometry=pline_2, Shader=swatch)

X = UnitX(Factor=expr("-x", number_slider_2))
move_3 = Move(Geometry=rev, Motion=X)  # -> Geometry, Transform
dist_2 = Distance(PointA=departicle.ReferencePosition, PointB=move_3.Geometry)
dom_3 = ConstructDomain(DomainStart=Slider(105, range=0..1000), DomainEnd=Slider(0, range=0..100))
dom_4 = ConstructDomain(DomainStart=Slider(0, range=0..1), DomainEnd=Slider(1, range=0..1))
remap_2 = RemapNumbers(Value=dist_2, Source=dom_3, Target=dom_4)  # -> Mapped, Clipped
graph = GraphMapper(remap_2.Mapped, x0=0, x1=1, y0=0, y1=1, container_name="Power", Gx=0.6594203115, Gy=0.3550724387, power=2.486666702)

srf_cp_4 = SurfaceClosestPoint(Point=move_3.Geometry, Surface=srfenv._2DReferenceSurface)  # -> Point, UVPoint, Distance
evalsrf_3 = EvaluateSurface(Surface=inputsrf_2, Point=srf_cp_4.UVPoint)  # -> Point, Normal, Frame

seek_2 = SeekForce(Apply=not, Agent=desystem.Quelea, WeightMultiplier=graph, TargetPoint=evalsrf_3.Point)

# ==== cluster Branch
i = ClusterInput()
data = ClusterInput()
data_2 = Data(data)
viewer = ParamViewer(data_2)
item = ListItem(List=viewer, Index=i, Wrap=True)
branch = TreeBranch(Tree=data_2, Path=item, MaintainPaths=True)
B = ClusterOutput(branch)

# ==== cluster Branch_2
data = ClusterInput()
data_2 = Data(data)
viewer = ParamViewer(data_2)
i = ClusterInput()
item = ListItem(List=viewer, Index=i, Wrap=True)
branch = TreeBranch(Tree=data_2, Path=item, MaintainPaths=True)
B = ClusterOutput(branch)
