# Grasshopper definition braitenbergPoint_20150505.gh (Grasshopper 0.9.75)
# plug-ins: Agent

particle = ConstructParticle(
    UpDirection=Vector(0, 0, 1),
    Acceleration=Vector(0, 0, 0),
    Lifespan=Slider(-1, range=-1..1000),
    Mass=1,
    BodySize=1,
    HistoryLength=Slider(1000, range=0..1000))
vec = VectorXYZ(XComponent=Slider(0.1, range=0..1), YComponent=0, ZComponent=0)  # -> Vector, Length
agent = ConstructAgent(Particle=particle, MaxSpeed=0.5, MaxForce=0.1, VisionRadius=5, VisionAngle=360)
pt = Point(<point referenced from the Rhino model>)
srfenv = SurfaceEnvironment()  # -> Environment, _2DReferenceSurface
vehicle = ConstructVehicle(Agent=agent, WheelRadius=Slider(1, range=0..5))
ptemit = PointEmitter(
    ContinuousFlow=Toggle(False),
    CreationRate=Slider(5, range=0..10),
    NumberOfQuelea=Slider(1, range=0..10),
    MinimumInitialVelocity=vec.Vector,
    MaximumInitialVelocity=vec.Vector,
    Point=pt)  # -> flatten(Emitter)
system = System(QueleaSettings=vehicle, Emitters=ptemit)  # -> System, Quelea, QueleaNetwork
item = ListItem(List=system.Quelea, Index=0, Wrap=True)
Z = UnitZ(Factor=1)
getposhist = GetParticlePositionHistory(ParticleQuelea=system.Quelea)
getorientation = GetOrientation(ParticleQuelea=system.Quelea)
devehicle = DeconstructVehicle(Vehicle=item)  # -> Orientation, WheelPositions, WheelTangentialVelocity, WheelAngles, WheelRadii, WheelAngularVelocity
sph = Sphere(Base=devehicle.Orientation, Radius=expr("x/2", 1))
pln = Plane(devehicle.Orientation)
deplane = DeconstructPlane(Plane=simplify(pln))  # -> Origin, XAxis, YAxis, ZAxis
timer = Timer(TimerInterval=20, Target=[engine, system])
pline = PolyLine(Vertices=getposhist, Closed=False)  # -> flatten(Polyline)
engine = Engine(Reset=Toggle(True), System=system.System)
vdis = VectorDisplay(Anchor=devehicle.WheelPositions, Vector=devehicle.WheelTangentialVelocity)
pl = ConstructPlane(Origin=pln, XAxis=deplane.XAxis, YAxis=expr("-x", deplane.ZAxis))
circle = CircleCNR(Center=devehicle.WheelPositions, Normal=deplane.YAxis, Radius=devehicle.WheelRadii)
rotate = Rotate(Geometry=circle, Angle=devehicle.WheelAngles, Plane=pl)  # -> Geometry, Transform
pt_2 = Point(<point referenced from the Rhino model>)
pt_3 = Point(<point referenced from the Rhino model>)  # disabled
sensept = SensePointForce(
    Apply=True,
    WeightMultiplier=1,
    Vehicle=system.Quelea,
    VisionRadiusMultiplier=0.2,
    VisionAngleMultiplier=0.125,
    Crossed=Toggle(True),
    Point=[pt_2, pt_3],
    Radius=Slider(5, range=0..10))  # -> Force, DesiredVelocity, SensorValues, SensorPositions
divide = DivideCurve(Curve=rotate.Geometry, Count=2, Kinks=False)  # -> Points, Tangents, Parameters
ln = Line(StartPoint=graft(devehicle.WheelPositions), EndPoint=divide.Points)
curvepoint = PointOnCurve(rotate.Geometry, parameter=0)
panel = Panel(sensept.SensorValues)
