# Grasshopper definition dynamicSpatialDataStructure.gh (Grasshopper 0.9.75)
# plug-ins: Agent

number_slider = Slider(30, range=0..100)
dom = ConstructDomain(DomainStart=0, DomainEnd=number_slider)

pt = Point([<point referenced from the Rhino model> x31])
crv = Curve(<curve referenced from the Rhino model>)
explode = Explode(Curve=crv, Recursive=True)  # -> Segments, Vertices
divide = DivideCurve(Curve=explode.Segments, Count=5, Kinks=False)  # -> Points, Tangents, Parameters
qt = QuadTree(Points=pt, Plane=PlaneXY(0, 0, 0), Square=False, Group=5)  # -> Quads, Points
crv_2 = Curve(qt.Quads)
branch = Branch(data=divide.Points, i=Slider(0, range=0..10))
branch_2 = Branch_2(data=divide.Points, i=Slider(2, range=0..10))
branch_3 = Branch_2(data=divide.Points, i=Slider(1, range=0..10))
branch_4 = Branch_2(data=divide.Points, i=Slider(3, range=0..10))
pt_2 = Point(branch_2)
pt_3 = Point(branch_4)
pt_4 = Point(branch)
pt_5 = Point(branch_3)
ln = Line(StartPoint=pt_4, EndPoint=reverse(pt_2))
ln_2 = Line(StartPoint=pt_5, EndPoint=reverse(pt_3))

box = DomainBox(Base=PlaneXY(0, 0, 0), X=dom, Y=dom, Z=dom)
particle = ConstructParticle(
    MinimumInitialVelocity=Vector(-0.1, -0.1, -0.1),
    MaximumInitialVelocity=Vector(0.1, 0.1, 0.1),
    Acceleration=Vector(0, 0, 0),
    Lifespan=Slider(289, range=-1..1000),
    Mass=1,
    BodySize=1,
    HistoryLength=1)
aaboxenv = AxisAlignedBoxEnvironment(Box=box)
agent = ConstructAgent(Particle=particle, MaxSpeed=0.5, MaxForce=0.1, VisionRadius=5, VisionAngle=360)
boxemit = BoxEmitter(ContinuousFlow=True, CreationRate=1, NumberOfQuelea=0, Box=box)
system = System(Quelea=agent, Emitters=boxemit, Environment=aaboxenv)  # -> System, Quelea, QueleaNetwork
panel = Panel(system.QueleaNetwork)
timer = Timer(TimerInterval=20, Target=[engine, system])  # disabled
engine = Engine(Reset=Toggle(False), System=system.System)
departicle = DeconstructParticle(Particle=system.Quelea)  # -> Position, Velocity, Acceleration, Lifespan, SurfacePosition, SurfaceVelocity, SurfaceAcceleration
txt = Text(system.QueleaNetwork)
pt_6 = Point(departicle.Position)
dsds = CSharpScript(dataStructure=txt)  # -> out, A; inputs dataStructure: String
# ---------- dsds: C# ----------
    int dataStructureStream = 0;
    if(dataStructure.Equals("Quelea.SpatialCollectionAsBinLattice`1[Quelea.IQuelea]"))
    {
      dataStructureStream = 1;
    }
    else if(dataStructure.Equals("Quelea.SpatialCollectionAsOctTree`1[Quelea.IQuelea]")){
      dataStructureStream = 2;
    }

    A = dataStructureStream;
# ---------- end dsds ----------
item = ListItem(List=pt_6, Index=0, Wrap=True)  # -> flatten(Item)
dom² = ConstructDomain²(DomainU=number_slider, DomainV=number_slider)
bbox = BoundingBox(Content=item, Plane=PlaneXY(0, 0, 0), UnionBox=True)  # -> Box, Box_2
binlattice = BinLattice(I=dom²)
oct = OcTree(Points=item, Square=False, Group=5)  # -> Boxes, Points
filter = StreamFilter(Gate=dsds.A, Stream0=bbox.Box, Stream1=binlattice, Stream2=oct.Boxes)
gate = StreamGate(Stream=item, Gate=dsds.A)  # -> Target0, Target1, Target2
merge = Merge(Data1=gate.Target1, Data2=gate.Target2)
swatch = ColourSwatch(SwatchColor=RGB(0, 255, 255))
vdisex = VectorDisplayEx(Point=merge, Vector=unitize(departicle.Velocity), Colour=swatch, Width=1)
preview = CustomPreview(Geometry=gate.Target0, Shader=swatch)
preview_2 = CustomPreview(Geometry=filter, Shader=ColourSwatch(SwatchColor=RGBA(28, 28, 28, 0)))

# ==== cluster BinLattice
I = ClusterInput()
series = Series(Start=0, Step=Slider(5, range=0..10), Count=Slider(7, range=0..10))
divide = DivideDomain²(Domain=I, UCount=6, VCount=6)
dedom2 = DeconstructDomain²(Domain=divide)  # -> UComponent, VComponent
dom = ConstructDomain(DomainStart=0, DomainEnd=series)
box = DomainBox(Base=PlaneXY(0, 0, 0), X=dedom2.UComponent, Y=dedom2.VComponent, Z=graft(dom))
B = ClusterOutput(box)

# ==== cluster Branch
i = ClusterInput()
data = ClusterInput()
data_2 = Data(data)
viewer = ParamViewer(data_2)
item = ListItem(List=viewer, Index=i, Wrap=True)
branch = TreeBranch(Tree=data_2, Path=item, MaintainPaths=True)
B = ClusterOutput(branch)

# ==== cluster Branch_2
data = ClusterInput()
data_2 = Data(data)
i = ClusterInput()
viewer = ParamViewer(data_2)
item = ListItem(List=viewer, Index=i, Wrap=True)
branch = TreeBranch(Tree=data_2, Path=item, MaintainPaths=True)
B = ClusterOutput(branch)
