# Grasshopper definition flockingTest.gh (Grasshopper 0.9.75)
# plug-ins: Agent

number_slider = Slider(0.1, range=0..1)
number_slider_2 = Slider(236, range=-1..1000)
number_slider_3 = Slider(1, range=0..10)
number_slider_4 = Slider(10, range=0..10)
vec = VectorXYZ(XComponent=expr("-x", number_slider), YComponent=expr("-x", 0), ZComponent=expr("-x", 0))  # -> Vector, Length
vec_2 = VectorXYZ(XComponent=number_slider, YComponent=0, ZComponent=0)  # -> Vector, Length
toggle = BooleanToggle(False)
pt = ConstructPoint(XCoordinate=Slider(1.5, range=0..10), YCoordinate=0, ZCoordinate=0)
particle = ConstructParticle(
    MinimumInitialVelocity=vec.Vector,
    MaximumInitialVelocity=vec.Vector,
    Acceleration=Vector(0, 0, 0),
    Lifespan=30,
    Mass=1,
    BodySize=1,
    HistoryLength=1)
number_slider_5 = Slider(5, range=0..10)
ptemit = PointEmitter(ContinuousFlow=toggle, CreationRate=1, NumberOfQuelea=number_slider_3, Point=Point(0, 0, 0))
agent = ConstructAgent(Particle=particle, MaxSpeed=Slider(0.5, range=0..1), MaxForce=0.1, VisionRadius=5, VisionAngle=360)
ptemit_2 = PointEmitter(ContinuousFlow=toggle, CreationRate=1, NumberOfQuelea=number_slider_3, Point=pt)
multiplication = Multiplication(A=number_slider_5, B=Slider(0.333, range=0..1))
multiplication_2 = Multiplication(A=number_slider_5, B=Slider(0.667, range=0..1))
timer = Timer(TimerInterval=20, Target=[engine, system])
system = System(Quelea=agent, Emitters=[ptemit, ptemit_2])
desystem = DeconstructSystem(System=system)  # -> Quelea, QueleaNetwork
neighbors = GetNeighborsInRadius(Agent=desystem.Quelea, QueleaNetwork=desystem.QueleaNetwork, VisionRadius=number_slider_5, VisionAngle=360)
neighbors_2 = GetNeighborsInRadius(Agent=desystem.Quelea, QueleaNetwork=neighbors, VisionRadius=multiplication_2, VisionAngle=360)
neighbors_3 = GetNeighborsInRadius(Agent=desystem.Quelea, QueleaNetwork=neighbors_2, VisionRadius=multiplication, VisionAngle=360)
neighbors_4 = GetNeighborsInRadius(Agent=desystem.Quelea, QueleaNetwork=neighbors, VisionRadius=number_slider_5, VisionAngle=Slider(45, range=0..100))
engine = Engine(Reset=Toggle(True), System=system)
separate = SeparateForce(Apply=True, Agent=desystem.Quelea, WeightMultiplier=Slider(1, range=0..1), GetNeighborsInRadius=neighbors_3)  # disabled
cohese = CoheseForce(Apply=True, Agent=desystem.Quelea, WeightMultiplier=Slider(1, range=0..1), GetNeighborsInRadius=neighbors)  # disabled
align = AlignForce(Apply=True, Agent=desystem.Quelea, WeightMultiplier=Slider(0.1, range=0..1), GetNeighborsInRadius=neighbors_2)  # disabled
view = ViewForce(Apply=True, Agent=desystem.Quelea, WeightMultiplier=Slider(1, range=0..1), GetNeighborsInRadius=neighbors_4)
departicle = DeconstructParticle(Particle=desystem.Quelea)  # -> Position, Velocity, Acceleration, Lifespan, Mass, BodySize, ReferencePosition
vlen = VectorLength(Vector=separate)
item = ListItem(List=departicle.Position, Index=0, Wrap=True)  # -> flatten(Item)
vdis = VectorDisplay(Anchor=item, Vector=separate)
vdis_2 = VectorDisplay(Anchor=item, Vector=align)
vlen_2 = VectorLength(Vector=view)
vdis_3 = VectorDisplay(Anchor=item, Vector=departicle.Velocity)
vdis_4 = VectorDisplay(Anchor=item, Vector=view)
panel = Panel(vlen_2)
vlen_3 = VectorLength(Vector=departicle.Velocity)
preview = CustomPreview(Geometry=item, Shader=ColourSwatch(SwatchColor=RGB(255, 255, 255)))
panel_2 = Panel(vlen_3)
