# Grasshopper definition neighbors3ComponentTest.gh (Grasshopper 0.9.75)
# plug-ins: Agent

number_slider = Slider(100, range=0..1000)
number_slider_2 = Slider(100, range=0..100)
number_slider_3 = Slider(15, range=0..100)
toggle = BooleanToggle(True)
toggle_2 = BooleanToggle(False)
timer = Timer(TimerInterval=20, Target=[engine_2, system, engine])  # disabled
box = DomainBox(Base=PlaneXY(0, 0, 0), X=number_slider_3, Y=number_slider_3, Z=number_slider_3)
agent = Agent(
    Lifespan=number_slider_2,
    Mass=1,
    BodySize=1,
    MaximumSpeed=0.5,
    MaximumForce=0.1,
    VisionAngle=15,
    VisionRadius=5,
    LengthOfPositionHistory=1)  # disabled
agent_2 = Agent(
    Lifespan=number_slider_2,
    Mass=1,
    BodySize=1,
    MaximumSpeed=0.5,
    MaximumForce=0.1,
    VisionAngle=15,
    VisionRadius=5,
    LengthOfPositionHistory=1)
boxemit = BoxEmitter(Box=box, ContinuousFlow=toggle_2, CreationRate=1, NumberOfAgents=number_slider)
boxemit_2 = BoxEmitter(Box=box, ContinuousFlow=toggle_2, CreationRate=1, NumberOfAgents=number_slider)
separate = SeparateForce(Weight=1, VisionMultiplier=0.3333333333)
cohese = CoheseForce(Weight=1, VisionMultiplier=1)
system = AgentSystem(Agents=agent_2, Emitters=boxemit_2)
system_2 = AgentSystem(Agents=agent, Emitters=boxemit, Forces=[cohese, separate])
deconstructsystem = DeconstructSystem(System=system)  # -> Agents, AgentSystem
neighbors = NeighborsInRadius(VisionRadius=5, VisionAngle=360)
neighbors3 = NeighborsInRadius(Agent=deconstructsystem.Agents, AgentCollection=deconstructsystem.AgentSystem, VisionRadius=5, VisionAngle=360)
engine = Engine(Reset=toggle, Systems=system_2)
neighbors3_2 = NeighborsInRadius(Agent=deconstructsystem.Agents, AgentCollection=neighbors3, VisionRadius=Slider(1.667, range=0..10), VisionAngle=360)
engine_2 = Engine(Reset=toggle, System=system)
separate4 = SeparateForce(Agent=deconstructsystem.Agents, Neighbors=neighbors3_2)
deconstructagent = DeconstructAgent(Agent=engine)  # -> Position, Velocity, Acceleration, Lifespan, PositionHistory
cohese4 = CoheseForce(Agent=deconstructsystem.Agents, Neighbors=neighbors3)
deconstructac = DeconstructAgentCollection(AgentCollection=neighbors3)  # disabled
deconstructagent_2 = DeconstructAgent(Agent=deconstructsystem.Agents)  # -> Position, Velocity, Acceleration, Lifespan, PositionHistory
viewer = ParamViewer(deconstructac)  # disabled
preview = CustomPreview(Geometry=deconstructagent.Position, Shader=ColourSwatch(SwatchColor=RGB(0, 255, 255)))
swatch = ColourSwatch(SwatchColor=RGB(255, 0, 255))  # disabled
vdis = VectorDisplay(Anchor=deconstructagent_2.Position, Vector=cohese4)  # disabled
item = ListItem(List=viewer, Index=0, Wrap=True)  # disabled
vdis_2 = VectorDisplay(Anchor=deconstructagent_2.Position, Vector=deconstructagent_2.Velocity)  # disabled
branch = TreeBranch(Tree=deconstructac, Path=item, MaintainPaths=True)  # disabled
preview_2 = CustomPreview(Geometry=deconstructagent_2.Position, Shader=swatch)  # disabled
item_2 = ListItem(List=deconstructsystem.Agents, Index=0, Wrap=True)  # disabled
deconstructagent_3 = DeconstructAgent(Agent=branch)  # -> Position, Velocity, Acceleration, Lifespan, PositionHistory; disabled
number_slider_4 = Slider(5, range=0..10)  # disabled
deconstructagent_4 = DeconstructAgent(Agent=item_2)  # -> Position, Velocity, Acceleration, Lifespan, PositionHistory; disabled
swatch_2 = ColourSwatch(SwatchColor=RGB(255, 255, 255))  # disabled
swatch_3 = ColourSwatch(SwatchColor=RGB(255, 255, 0))  # disabled
sph = Sphere(Base=deconstructagent_4.Position, Radius=number_slider_4)  # disabled
preview_3 = CustomPreview(Geometry=deconstructagent_4.Position, Shader=swatch_2)  # disabled
preview_4 = CustomPreview(Geometry=deconstructagent_3.Position, Shader=swatch_3)  # disabled
