# Grasshopper definition neighborsComponentTest.gh (Grasshopper 0.9.75)
# plug-ins: Agent

number_slider = Slider(15, range=0..100)
number_slider_2 = Slider(100, range=0..100)
number_slider_3 = Slider(1000, range=0..1000)
toggle = BooleanToggle(False)
box = DomainBox(Base=PlaneXY(0, 0, 0), X=number_slider, Y=number_slider, Z=number_slider)
toggle_2 = BooleanToggle(False)
timer = Timer(TimerInterval=20, Target=[engine_2, system, engine])  # disabled
number_slider_4 = Slider(100, range=0..100)
agent = Agent(
    Lifespan=number_slider_4,
    Mass=1,
    BodySize=1,
    MaximumSpeed=0.5,
    MaximumForce=0.1,
    VisionAngle=15,
    VisionRadius=5,
    LengthOfPositionHistory=1)  # disabled
boxemit = BoxEmitter(Box=box, ContinuousFlow=toggle, CreationRate=1, NumberOfAgents=number_slider_2)
boxemit_2 = BoxEmitter(Box=box, ContinuousFlow=toggle, CreationRate=1, NumberOfAgents=number_slider_2)
agent_2 = Agent(
    Lifespan=number_slider_4,
    Mass=1,
    BodySize=1,
    MaximumSpeed=0.5,
    MaximumForce=0.1,
    VisionAngle=15,
    VisionRadius=5,
    LengthOfPositionHistory=1)
cohese = CoheseForce(Weight=1, VisionMultiplier=1)
system = AgentSystem(Agents=agent_2, Emitters=boxemit)
cohese_2 = CoheseForce(System1=system, System2=system, VisionAngle=360, VisionRadiusMutliplier=1)  # disabled
system_2 = AgentSystem(Agents=agent, Emitters=boxemit_2, Forces=cohese)
deconstructsystem = DeconstructSystem(System=system)
neighbors = NeighborsInRadius(Agent=deconstructsystem, System=system, VisionRadius=5, VisionAngle=360)  # -> simplify(Neighbors)
engine = Engine(Reset=toggle_2, Systems=system_2)
cohese2 = CoheseForce(Agent=simplify(graft(deconstructsystem)), Neighbors=simplify(neighbors))  # -> simplify(flatten(CohesionForce))
engine_2 = Engine(Reset=toggle_2, System=system, Forces=cohese2)
deconstructagent = DeconstructAgent(Agent=engine)  # -> Position, Velocity, Acceleration, Lifespan, PositionHistory
deconstructagent_2 = DeconstructAgent(Agent=neighbors)  # -> Position, Velocity, Acceleration, Lifespan, PositionHistory; disabled
deconstructagent_3 = DeconstructAgent(Agent=deconstructsystem)  # -> Position, Velocity, Acceleration, Lifespan, PositionHistory
vdis = VectorDisplay(Anchor=deconstructagent_3.Position, Vector=cohese_2)  # disabled
vdis_2 = VectorDisplay(Anchor=deconstructagent_3.Position, Vector=deconstructagent_3.Velocity)  # disabled
viewer = ParamViewer(deconstructagent_2.Position)  # disabled
vdis_3 = VectorDisplay(Anchor=deconstructagent_3.Position, Vector=cohese2)  # disabled
number_slider_5 = Slider(5, range=0..10)  # disabled
item = ListItem(List=flatten(deconstructagent_3.Position), Index=0, Wrap=True)  # disabled
item_2 = ListItem(List=viewer, Index=0, Wrap=True)  # disabled
branch = TreeBranch(Tree=deconstructagent_2.Position, Path=item_2, MaintainPaths=True)  # disabled
swatch = ColourSwatch(SwatchColor=RGB(255, 255, 255))  # disabled
swatch_2 = ColourSwatch(SwatchColor=RGB(0, 255, 255))  # disabled
sph = Sphere(Base=item, Radius=number_slider_5)  # disabled
preview = CustomPreview(Geometry=item, Shader=swatch)  # disabled
preview_2 = CustomPreview(Geometry=branch, Shader=swatch_2)  # disabled
