# Grasshopper definition polymorphicTypeTest.gh (Grasshopper 0.9.75)
# plug-ins: Agent

number_slider = Slider(0.04, range=0..1)
number_slider_2 = Slider(0.04, range=0..1)
number_slider_3 = Slider(0.03, range=0..1)
vec = VectorXYZ(XComponent=expr("-x", number_slider_2), YComponent=expr("-x", number_slider), ZComponent=number_slider_3)  # -> Vector, Length
pt = ConstructPoint(XCoordinate=0, YCoordinate=0, ZCoordinate=0)
vec_2 = VectorXYZ(XComponent=number_slider_2, YComponent=number_slider, ZComponent=number_slider_3)  # -> Vector, Length
vec_3 = VectorXYZ(XComponent=0, YComponent=0, ZComponent=Slider(0.09, range=0..0.1))  # -> Vector, Length
number_slider_4 = Slider(1, range=0..10)
vdis = VectorDisplay(Anchor=pt, Vector=vec.Vector)
vdis_2 = VectorDisplay(Anchor=pt, Vector=vec_2.Vector)
particle = ConstructParticle(
    MinimumInitialVelocity=Vector(-0.1, -0.1, -0.1),
    MaximumInitialVelocity=Vector(0.1, 0.1, 0.1),
    Acceleration=Vector(0, 0, 0),
    Lifespan=Slider(140, range=0..1000),
    Mass=1,
    BodySize=1,
    HistoryLength=Slider(4, range=0..10))
ptemit = PointEmitter(ContinuousFlow=True, CreationRate=1, NumberOfQuelea=0, Point=Point(0, 0, 0))
agent = ConstructAgent(Particle=particle, MaxSpeed=0.5, MaxForce=0.1, VisionRadius=5, VisionAngle=360)
timer = Timer(TimerInterval=20, Target=[system, engine])  # disabled
system = System(Quelea=agent, Emitters=ptemit)
engine = Engine(Reset=Toggle(False), System=system)
desystem = DeconstructSystem(System=system)  # -> Quelea, QueleaNetwork
neighbors = GetNeighborsInRadius(Agent=desystem.Quelea, QueleaNetwork=desystem.QueleaNetwork, VisionRadius=5, VisionAngle=360)
swatch = ColourSwatch(SwatchColor=RGB(97, 169, 255))
dequelea = DeconstructQuelea(Quelea=desystem.Quelea)  # -> simplify(Position), Velocity, Acceleration, Lifespan, ReferencePosition
deconstructqn = DeconstructQueleaNetwork(QueleaNetwork=neighbors)
Z = UnitZ(Factor=expr("-x", Slider(0.01, range=0..0.1)))
number_slider_5 = Slider(0.15, range=0..1)
cloud = CloudDisplay(Points=flatten(dequelea.Position), Colours=swatch, Size=number_slider_5, SpriteType=0)  # disabled
applyforce = ApplyCustomForce(Apply=True, Agent=desystem.Quelea, WeightMultiplier=1, ForceVector=Z)
cohese = CoheseForce(Apply=True, Agent=desystem.Quelea, WeightMultiplier=Slider(0, range=0..1), GetNeighborsInRadius=neighbors)
dots = DotDisplay(Point=dequelea.Position, Colour=swatch, Size=number_slider_5)  # disabled
panel = Panel(dequelea.Position)
pline = PolyLine(Vertices=dequelea.Position, Closed=False)
viewer = ParamViewer(dequelea.Position)
intcrv = Interpolate(Vertices=dequelea.Position, Degree=3, Periodic=False, KnotStyle=1)  # -> flatten(Curve), Length, Domain
item = ListItem(List=viewer, Index=0, Wrap=True)
branch = TreeBranch(Tree=dequelea.Position, Path=item, MaintainPaths=True)
