# Grasshopper definition polysrfEnvTest.gh (Grasshopper 0.9.75)
# plug-ins: Agent

# ----
# POINT EMITTER
# Point from which to emit agents.
# If continuous flow, Agents will be consistently emitted. Limit the number of agnets allowed at once with the Number of Agents setting.
toggle = BooleanToggle(True)
agent_vision_radius_multiplier = Slider(3, range=0..10)
agent_cohesion_vision_radius = Slider(5, range=0..10)

# ----
# CONSTRUCT AGENT
# Agent Settings:
# Initializes agents with these settings. The settings cannot change once the agent has been emitted. If there is just 1 Agent output from A, all the agents will have that setting. If you would like a diversity of agent settings for each agent, feed in a list of values into the settings you would like to be different.
number_slider = Slider(1000, range=0..1000)
brep = Brep(<brep referenced from the Rhino model>)
pt = Point(<point referenced from the Rhino model>)
brep_2 = Brep(<brep referenced from the Rhino model>)
brep_3 = Brep(<brep referenced from the Rhino model>)
brep_4 = Brep(<brep referenced from the Rhino model>)
srf = Surface(<surface referenced from the Rhino model>)
ptemit = PointEmitter(Point=pt, ContinuousFlow=toggle, CreationRate=1, NumberOfAgents=Slider(7, range=0..100))
pt_2 = Point(<point referenced from the Rhino model>)
agent = ConstructAgent(
    Lifespan=number_slider,
    Mass=1,
    BodySize=Slider(0.5, range=0..1),
    MaxSpeed=Slider(0.1, range=0..1),
    MaxForce=Slider(0.1, range=0..1),
    HistoryLength=Slider(1, range=0..10))
polysrfenv = PolysurfaceEnvironment(Brep=brep)
c_script = CSharpScript(srf=srf)  # -> out, A; inputs srf: Surface
# ---------- c_script: C# ----------
    srf.SetDomain(0, new Interval(0, 1));
    srf.SetDomain(1, new Interval(0, 1));
    A = srf;
# ---------- end c_script ----------
pt_3 = Point(<point referenced from the Rhino model>)
vec2pt = Vector2Pt(PointA=pt_3, PointB=pt_2, Unitize=False)  # -> Vector, Length
srf_2 = Surface(c_script.A)
c_script_2 = CSharpScript(environment=brep, P=pt_3, V=vec2pt.Vector, S=Slider(1, range=0..1))  # -> out, A, B, C, D, E, F, AA; inputs environment: Brep, P: Point3d, V: Vector3d, S: Double
# ---------- c_script_2: C# ----------
    this.environment = environment;
    Curve[] borderCrvs = GetNakedEdges();
    A = borderCrvs.ToList();


    IEnumerable<Point3d> edgePts = DivByAngle(borderCrvs, 1.0);
    B = edgePts;
    IEnumerable<Vector3d> normals = GetBrepNormals(edgePts);
    C = normals;
    double borderSize = environment.GetBoundingBox(Plane.WorldXY).Diagonal.Length / 10;
    borderWalls = GetBorderWalls(borderCrvs, edgePts, normals, borderSize);
    D = borderWalls;

    AgentType agent = new AgentType(P, V, S);
    double distance = 1.0;

    Vector3d steer = new Vector3d();
    Vector3d avoidVec, parVec;

    Vector3d velocity = agent.Velocity;
    Point3d position = agent.Position;

    double tol = 0.01;

    Curve[] overlapCrvs;
    Point3d[] intersectPts;

    Curve[] feelers = GetFeelerCrvs(agent, distance, true);

    E = feelers.ToList();
    List<Vector3d> borderNormals = new List<Vector3d>();

    int count = 0;

    foreach (Curve feeler in feelers)
    {
      foreach (Brep brep in borderWalls)
      {
        //Check feeler intersection with each brep face
        foreach (BrepFace face in brep.Faces)
        {
          Rhino.Geometry.Intersect.Intersection.CurveBrepFace(feeler, face, tol, out overlapCrvs, out intersectPts);
          if (intersectPts.Length > 0)
          {
            Point3d testPt = feeler.PointAtEnd;
            double u, v;
            face.ClosestPoint(testPt, out u, out v);
            Vector3d normal = face.NormalAt(u, v);
            normal.Reverse();
            Vector.GetProjectionComponents(normal, velocity, out parVec, out avoidVec);
            avoidVec.Unitize();
            //weight by distance
            avoidVec = Vector3d.Divide(avoidVec, position.DistanceTo(intersectPts[0]));
            steer = Vector3d.Add(steer, avoidVec);
            count++;
            break; //Break when we hit a face
          }
        }
      }
    }
    if (count > 0)
    {
      steer = Vector3d.Divide(steer, count);
    }
    F = steer;
# ---------- c_script_2: C# additional code ----------
  public Brep environment;
  public Brep[] borderWalls;
  private Curve[] GetNakedEdges()
  {
    List<Curve> nakedEdges = new List<Curve>();
    foreach (BrepEdge edge in environment.Edges)
    {
      // Find only the naked edges
      if (edge.Valence == EdgeAdjacency.Naked)
      {
        Curve crv = edge.DuplicateCurve();
        if (null != crv)
          nakedEdges.Add(crv);
      }
    }
    RhinoDoc doc = RhinoDoc.ActiveDoc;
    double tol = 2.1 * doc.ModelAbsoluteTolerance;

    return Curve.JoinCurves(nakedEdges, tol);
  }

    /**
     * divideCrvsByDeltaTan : Curve[] * double -> LinkedList<Plane>
     * REQUIRES: theta > 0
     * ENSURES: divideCrvsByDeltaTan(crvs, theta) returns a linked list of planes
     *          along the curves s.t. there is a plane at every point along
     *          the curve where the change in the tangent vector between
     *          two points is greater than theta.
    **/
  private IEnumerable<Point3d> DivByAngle(Curve[] crvs, double angle)
  {

    //initialize parameters
    double theta = angle;
    const double stepSize = 0.5;

    //initialize list
    List<Point3d> pts = new List<Point3d>();

    Continuity c = Continuity.C1_continuous;

    foreach(Curve crv in crvs)
    {
      //initialize data
      Interval dom = crv.Domain;
      double rover = dom.Min; //steps along the curve by stepSize

      //Add plane at start point of curve to list
      Point3d pt = crv.PointAt(rover);
      pts.Add(pt);

      //Increment
      Vector3d prevTan = crv.TangentAt(rover);
      double oldRover = rover; //stores the previous rover for comparison
      rover += stepSize;

      while (rover < dom.Max)
      {
        Vector3d currTan = crv.TangentAt(rover);
        //If there is a discontinuity between the oldRover and rover
        //then place a point at the discontinuity and update prevTan.
        double discontinuity;
        bool isDisc = crv.GetNextDiscontinuity(c, oldRover, rover,
          out discontinuity);
        if (isDisc)
        {
          pt = crv.PointAt(discontinuity);
          pts.Add(pt);
          prevTan = crv.TangentAt(discontinuity);
        }

        //If the change in tangent vector is greater than theta,
        //then drop a target at the rover and update prevTan.
        double delta = RhinoMath.ToDegrees(Math.Abs(Vector3d.VectorAngle(prevTan, currTan)));
        if (delta > theta)
        {
          pt = crv.PointAt(rover);
          pts.Add(pt);
          prevTan = currTan;
        }
        //Increment
        oldRover = rover;
        rover += stepSize;
      }

      //Add target at end point of curve
      pt = crv.PointAt(dom.Max);
      pts.Add(pt);
    }
    return pts;
  }

  private IEnumerable<Vector3d> GetBrepNormals(IEnumerable<Point3d> pts)
  {
    //Initialize variables
    List<Surface> brepSrfs = new List<Surface>();
    List<Vector3d> normals = new List<Vector3d>();
    const double epsilon = 0.000001; //The minimum distance to determine which surface a pt is touching.

    //Explode brep
    Rhino.Geometry.Collections.BrepFaceList brepFaces = environment.Faces;
    foreach(BrepFace face in brepFaces)
    {
      Surface srf = face.ToBrep().Surfaces[0];
      if(face.OrientationIsReversed)
      {
        brepSrfs.Add(srf.Reverse(0));
      }
      else {
        brepSrfs.Add(srf);
      }
    }

      /*
      for each point, get the closest point to each surface
      */
    foreach(Point3d pt in pts) {
      List<Plane> framesTemp = new List<Plane>();
      foreach(Surface srf in brepSrfs) {
        double u;
        double v;
        srf.ClosestPoint(pt, out u, out v);
        Plane frame;
        srf.FrameAt(u, v, out frame);
        if(pt.DistanceTo(frame.Origin) <= epsilon) {
          framesTemp.Add(frame);
        }
      }
        /*
        if there is 1 close surface:
          add the two normal vectors together to get the bisector
        */
      Vector3d brepNormal;
      if(framesTemp.Count == 1) {
        brepNormal = framesTemp[0].Normal;
      }
        /*
        if there are 2 equally close surfaces:
          add the two normal vectors together to get the bisector
        */
      else {
        brepNormal = framesTemp[0].Normal;
        foreach(Plane pln in framesTemp) {
          brepNormal = Vector3d.Add(brepNormal, pln.Normal);
        }
      }

      //Set magnitude to distance.
      brepNormal.Unitize();

      normals.Add(brepNormal);
    }
    return normals;
  }

  private Brep[] GetBorderWalls(Curve[] borderCrvs, IEnumerable<Point3d> pts, IEnumerable<Vector3d> nrmls, double dist)
  {
    List<Point3d> ptsOut = new List<Point3d>();
    List<Point3d> ptsIn = new List<Point3d>();
    IEnumerator ptEnum = pts.GetEnumerator();
    IEnumerator nrmlEnum = nrmls.GetEnumerator();
    while ((ptEnum.MoveNext()) && (nrmlEnum.MoveNext()))
    {
      Point3d pt = (Point3d) ptEnum.Current;
      Vector3d nrml = (Vector3d) nrmlEnum.Current;
      Transform mvOut = Transform.Translation(nrml * dist);
      Transform mvIn = Transform.Translation(nrml * -dist);
      Point3d ptOut = new Point3d(pt);
      Point3d ptIn = new Point3d(pt);
      ptOut.Transform(mvOut);
      ptIn.Transform(mvIn);
      ptsOut.Add(ptOut);
      ptsIn.Add(ptIn);
    }

    Curve crvOut;
    Curve crvIn;

    if(borderCrvs[0].IsPolyline()) {
      crvOut = new PolylineCurve(ptsOut);
      crvIn = new PolylineCurve(ptsIn);
    }
    else {
      crvOut = Curve.CreateInterpolatedCurve(ptsOut, 3);
      crvIn = Curve.CreateInterpolatedCurve(ptsIn, 3);
    }
    List<Curve> crvs = new List<Curve>();
    crvs.Add(crvOut);
    crvs.Add(crvIn);
    Brep[] lofts = Brep.CreateFromLoft(crvs, Point3d.Unset, Point3d.Unset, LoftType.Normal, false);

    double minSoFar = Double.MaxValue;
    Interval interval = new Interval(0, 1);
    Point3d loftPt = lofts[0].Faces[0].PointAt(0, 0);
    BrepFace testFace = environment.Faces[0];
    Point3d facePt = testFace.PointAt(0.25, 0.25);
    foreach(BrepFace face in environment.Faces) {
      double u, v;
      face.ClosestPoint(loftPt, out u, out v);
      facePt = face.PointAt(u, v);
      dist = loftPt.DistanceTo(facePt);
      if(dist < minSoFar) {
        minSoFar = dist;
        testFace = face;
      }
    }

    Vector3d loftNrml = lofts[0].Faces[0].NormalAt(0, 0);
    testFace.SetDomain(0, interval);
    testFace.SetDomain(1, interval);
    facePt = testFace.PointAt(0.5, 0.5);
    Vector3d testVec = Vector3d.Subtract(new Vector3d(facePt), new Vector3d(loftPt));
    double dotProd = Vector3d.Multiply(loftNrml, testVec) / (loftNrml.Length * testVec.Length);
    if(dotProd >= 0) {
      foreach(Brep brep in lofts) {
        brep.Flip();
      }
    }
    return lofts;
  }

  private static Curve GetFeelerCrv(Vector3d feelerVec, Point3d position,
    double bodySize, double visionAngle,
    Vector3d rotAxis)
  {
    feelerVec.Rotate(visionAngle, rotAxis);
    feelerVec = Vector3d.Multiply(feelerVec, bodySize);
    return new Line(position, feelerVec).ToNurbsCurve();
  }

  private static Curve[] GetFeelerCrvs(AgentType agent, double visionDistance,
    bool accurate)
  {
    Curve[] feelers;
    if (accurate)
    {
      feelers = new Curve[5];
    }
    else
    {
      feelers = new Curve[1];
    }

    double feelerAngle = Math.PI / 2;
    //Calculate straight ahead feeler with length visionDistance
    Vector3d feelerVec = agent.Velocity;
    feelerVec.Unitize();
    feelerVec = Vector3d.Multiply(feelerVec, visionDistance);
    feelers[0] = new Line(agent.Position, feelerVec).ToNurbsCurve();

    if (!accurate)
    {
      return feelers;
    }

    //Calculate tertiary feelers with length bodySize
    feelerVec = agent.Velocity;
    feelerVec.Unitize();
    Plane rotPln = new Plane(agent.Position, agent.Velocity);
    Vector3d rotAxis = rotPln.XAxis;
    feelers[1] = GetFeelerCrv(feelerVec, agent.RefPosition, agent.BodySize, feelerAngle, rotAxis);
    feelers[2] = GetFeelerCrv(feelerVec, agent.RefPosition, agent.BodySize, -feelerAngle, rotAxis);
    rotAxis = rotPln.YAxis;
    feelers[3] = GetFeelerCrv(feelerVec, agent.RefPosition, agent.BodySize, feelerAngle, rotAxis);
    feelers[4] = GetFeelerCrv(feelerVec, agent.RefPosition, agent.BodySize, -feelerAngle, rotAxis);

    return feelers;
  }

  public Vector3d AvoidEdges(AgentType agent, double distance)
  {
    Vector3d steer = new Vector3d();
    Vector3d avoidVec, parVec;

    Vector3d velocity = agent.Velocity;
    Point3d position = agent.Position;

    double tol = 0.01;

    Curve[] overlapCrvs;
    Point3d[] intersectPts;

    Curve[] feelers = GetFeelerCrvs(agent, distance, true);
    int count = 0;

    foreach (Curve feeler in feelers)
    {
      foreach (Brep brep in borderWalls)
      {
        //Check feeler intersection with each brep face
        foreach (BrepFace face in brep.Faces)
        {
          Rhino.Geometry.Intersect.Intersection.CurveBrepFace(feeler, face, tol, out overlapCrvs, out intersectPts);
          if (intersectPts.Length > 0)
          {
            Point3d testPt = feeler.PointAtEnd;
            double u, v;
            face.ClosestPoint(testPt, out u, out v);
            Vector3d normal = face.NormalAt(u, v);
            normal.Reverse();
            Vector.GetProjectionComponents(normal, velocity, out parVec, out avoidVec);
            avoidVec.Unitize();
            //weight by distance
            avoidVec = Vector3d.Divide(avoidVec, position.DistanceTo(intersectPts[0]));
            steer = Vector3d.Add(steer, avoidVec);
            count++;
            break; //Break when we hit a face
          }
        }
      }
    }
    if (count > 0)
    {
      steer = Vector3d.Divide(steer, count);
    }

    return steer;
  }

  public class AgentType {
    public Point3d Position, RefPosition;
    public Vector3d Velocity;
    public double BodySize;
    public AgentType(Point3d position, Vector3d velocity, double bodySize) {
      this.Position = this.RefPosition = position;
      this.Velocity = velocity;
      this.BodySize = bodySize;
    }
  }

  class Vector
  {
    private Vector() { }

    public static double RadToDeg(double rad)
    {
      return rad * (180 / Math.PI);
    }

    public static double DotProduct(Vector3d a, Vector3d b)
    {
      return a.Length * b.Length * Math.Cos(Vector3d.VectorAngle(a, b));
    }

    public static Vector3d Reflect(Vector3d to, Vector3d about)
    {
      return Vector3d.Subtract(to, Vector3d.Multiply(2 * DotProduct(to, about), about));
    }

    public static void GetProjectionComponents(Vector3d of, Vector3d to, out Vector3d parVec, out Vector3d perpVec)
    {
      double scalar = DotProduct(of, to) / (to.Length * to.Length);
      parVec = Vector3d.Multiply(to, scalar);
      perpVec = Vector3d.Subtract(of, parVec);
    }

    public static double LengthSq(Vector3d vec)
    {
      return Math.Pow(vec.X, 2) + Math.Pow(vec.Y, 2) + Math.Pow(vec.Z, 2);
    }

    public static Vector3d Limit(Vector3d vec, double max)
    {
      if (LengthSq(vec) > max * max)
      {
        vec.Unitize();
        vec = Vector3d.Multiply(vec, max);
      }
      return vec;
    }

    public static double CalcAngle(Vector3d vec1, Vector3d vec2, Plane pl)
    {
      double angle = Vector3d.VectorAngle(vec1, vec2, pl);
      angle = RadToDeg(angle);
      if (angle > 180) angle = 360 - angle;
      return angle;
    }
  }
# ---------- end c_script_2 ----------
# SYSTEM
# Creates a system of Agents that the engine will be able to run.
system = System(Agents=agent, Emitters=ptemit, Environment=polysrfenv)
crv = Curve(c_script_2.A)
c_script_3 = CSharpScript(crv=crv)  # -> out, A; inputs crv: Curve
# ---------- c_script_3: C# ----------
    if(crv.IsPolyline()) {
      A = true;
    }
    else {
      A = false;
    }
# ---------- end c_script_3 ----------
vec = Vector(c_script_2.F)
brep_5 = Brep(c_script_2.D)
crv_2 = Curve(c_script_2.A)
crv_3 = Curve(c_script_2.E)
c_script_4 = CSharpScript(env=brep)  # -> out, A; inputs env: Brep
# ---------- c_script_4: C# ----------
    Curve[] borderCrvs = calcBorder(env);

    A = borderCrvs;
# ---------- c_script_4: C# additional code ----------
  public Curve[] calcBorder(Brep env) {
    List<Curve> nakedEdges = new List<Curve>();
    foreach(BrepEdge edge in env.Edges) {
      // Find only the naked edges
      if (edge.Valence == EdgeAdjacency.Naked)
      {
        Curve crv = edge.DuplicateCurve();
        if (null != crv)
          nakedEdges.Add(crv);
      }
    }
    double tol = 2.1 * doc.ModelAbsoluteTolerance;
    return Curve.JoinCurves(nakedEdges, tol);
  }
# ---------- end c_script_4 ----------
# The Agent's vision radius for separation here has a stable ratio to the cohesion vision radius so that a stable behavior is formed
panel = Panel(c_script_3.A)
pt_4 = Point(c_script_2.B)
vec_2 = Vector(c_script_2.C)
# Pause the simlation by double-clicking the Timer.
timer = Timer(TimerInterval=20, Target=[engine, system])  # disabled
# Reset the simulation by double-clicking the reset switch.
toggle_2 = BooleanToggle(True)
avr = Average(Input=vec_2)  # disabled
# DECONSTRUCT SYSTEM
# Exposes the list of Agents, A, and the AgentCollection, AC, which is a spatial data structure that allows for the fast lookup of neighbors.
division = Division(A=agent_cohesion_vision_radius, B=agent_vision_radius_multiplier)
panel_2 = Panel(c_script_2.AA)
deconstructsystem = DeconstructSystem(System=system)  # -> Agents, AgentCollection
vdis = VectorDisplay(Anchor=pt_4, Vector=vec_2)
eval = EvaluateCurve(Curve=reparameterize(crv), Parameter=0)  # -> Point, Tangent, Angle
crv_4 = Curve(c_script_4.A)
divbyangle = CSharpScript(crvs=graft(crv_4), angle=Slider(1, range=0..100))  # -> out, P; inputs crvs: list of Curve, angle: Double
# ---------- divbyangle: C# ----------
                                                                                                                              /*
  divideCrvsByDeltaTan : Curve[] * double -> LinkedList<Plane>
  REQUIRES: theta > 0
  ENSURES: divideCrvsByDeltaTan(crvs, theta) returns a linked list of planes
           along the curves s.t. there is a plane at every point along
           the curve where the change in the tangent vector between
           two points is greater than theta.
  */
    //initialize parameters
    double theta = angle;
    int n = crvs.Count;
    double stepSize = 0.5;
    Vector3d xAxis = new Vector3d(1, 0, 0);
    double rover; //steps along the curve by stepSize
    double oldRover; //stores the previous rover for comparison
    double discontinuity;
    Vector3d prevTan;
    Vector3d currTan;
    Curve crv;
    Interval dom;

    //initialize list
    List< Point3d > pts = new List<Point3d>();
    Point3d pt;

    Rhino.Geometry.Continuity c = Rhino.Geometry.Continuity.C1_continuous;

    for(int i = 0; i < n; i++)
    {
      crv = crvs[i];

      //initialize data
      dom = crv.Domain;
      rover = dom.Min;

      //Add plane at start point of curve to list
      pt = crv.PointAt(rover);
      pts.Add(pt);

      //Increment
      prevTan = crv.TangentAt(rover);
      oldRover = rover;
      rover += stepSize;

      while(rover < dom.Max)
      {
        currTan = crv.TangentAt(rover);
        //If there is a discontinuity between the oldRover and rover
        //then place a point at the discontinuity and update prevTan.
        bool isDisc = crv.GetNextDiscontinuity(c, oldRover, rover,
          out discontinuity);
        if(isDisc)
        {
          pt = crv.PointAt(discontinuity);
          pts.Add(pt);
          prevTan = crv.TangentAt(discontinuity);
        }

        //If the change in tangent vector is greater than theta,
        //then drop a target at the rover and update prevTan.
        double delta = RhinoMath.ToDegrees(Math.Abs(Vector3d.VectorAngle(prevTan, currTan)));
        if(delta > theta)
        {
          pt = crv.PointAt(rover);
          pts.Add(pt);
          prevTan = currTan;
        }
        //Increment
        oldRover = rover;
        rover += stepSize;
      }

      //Add target at end point of curve
      pt = crv.PointAt(dom.Max);
      pts.Add(pt);
    }
    P = pts;
# ---------- end divbyangle ----------
formingpts = FormingPts(orientedgeo=brep, contactpts=divbyangle.P)
vdis_2 = VectorDisplay(Anchor=pt_4, Vector=avr)  # disabled
vdis_3 = VectorDisplay(Anchor=pt_3, Vector=vec)
getborderwalls = CSharpScript(environment=brep, pts=c_script_2.B, nrmls=c_script_2.C)  # -> out, A, B, C, D, E, F; inputs environment: Brep, pts: list of Point3d, nrmls: list of Vector3d
# ---------- getborderwalls: C# ----------
    double dist = 1.5;
    List<Point3d> ptsOut = new List<Point3d>();
    List<Point3d> ptsIn = new List<Point3d>();
    IEnumerator ptEnum = pts.GetEnumerator();
    IEnumerator nrmlEnum = nrmls.GetEnumerator();
    while ((ptEnum.MoveNext()) && (nrmlEnum.MoveNext()))
    {
      Point3d pt = (Point3d) ptEnum.Current;
      Vector3d nrml = (Vector3d) nrmlEnum.Current;
      Transform mvOut = Transform.Translation(nrml * dist);
      Transform mvIn = Transform.Translation(nrml * -dist);
      Point3d ptOut = new Point3d(pt);
      Point3d ptIn = new Point3d(pt);
      ptOut.Transform(mvOut);
      ptIn.Transform(mvIn);
      ptsOut.Add(ptOut);
      ptsIn.Add(ptIn);
    }
    Curve crvOut = Curve.CreateInterpolatedCurve(ptsOut, 3);
    Curve crvIn = Curve.CreateInterpolatedCurve(ptsIn, 3);
    List<Curve> crvs = new List<Curve>();
    crvs.Add(crvOut);
    crvs.Add(crvIn);
    Brep[] lofts = Brep.CreateFromLoftRebuild(crvs, Point3d.Unset, Point3d.Unset, LoftType.Normal, false, pts.Count());

    Surface testSrf = environment.Surfaces[0];
    Interval interval = new Interval(0, 1);
    testSrf.SetDomain(0, interval);
    testSrf.SetDomain(1, interval);
    Point3d envTestPt = testSrf.PointAt(0.25, 0.25);
    BrepFace testFace = lofts[0].Faces[0];
    Point3d facePt = testFace.PointAt(0.25, 0.25);
    double testU = 0;
    double testV = 0;
    double minSoFar = Double.MaxValue;
    foreach(BrepFace face in lofts[0].Faces) {
      double u, v;
      face.ClosestPoint(envTestPt, out u, out v);
      facePt = face.PointAt(u, v);
      dist = envTestPt.DistanceTo(facePt);
      if(dist < minSoFar) {
        testFace = face;
        testU = u;
        testV = v;
      }
    }

    Vector3d faceNrml = testFace.NormalAt(testU, testV);
    B = facePt;
    C = faceNrml;

    Vector3d testVec = Vector3d.Subtract(new Vector3d(facePt), new Vector3d(envTestPt));
    D = facePt;
    E = testVec;
    double dotProd = Vector3d.Multiply(faceNrml, testVec) / (faceNrml.Length * testVec.Length);
    F = dotProd;
    if(dotProd >= 0) {
      foreach(Brep brep in lofts) {
        //brep.Flip();
      }
    }
    A = lofts.ToList();
# ---------- end getborderwalls ----------
vdis_4 = VectorDisplay(Anchor=eval.Point, Vector=eval.Tangent)
number_slider_2 = Slider(0.5, range=0..1)
engine = Engine(Reset=toggle_2, System=system)
getborderwalls_2 = CSharpScript(environment=brep, borderCrv=crv_2, pts=c_script_2.B, nrmls=c_script_2.C)  # -> out, A, B, C, D, E, F, AA, AB, AC; inputs environment: Brep, borderCrv: Curve, pts: list of Point3d, nrmls: list of Vector3d
# ---------- getborderwalls_2: C# ----------
    double dist = 1.5;

    List<Point3d> ptsOut = new List<Point3d>();
    List<Point3d> ptsIn = new List<Point3d>();
    IEnumerator ptEnum = pts.GetEnumerator();
    IEnumerator nrmlEnum = nrmls.GetEnumerator();
    while ((ptEnum.MoveNext()) && (nrmlEnum.MoveNext()))
    {
      Point3d pt = (Point3d) ptEnum.Current;
      Vector3d nrml = (Vector3d) nrmlEnum.Current;
      Transform mvOut = Transform.Translation(nrml * dist);
      Transform mvIn = Transform.Translation(nrml * -dist);
      Point3d ptOut = new Point3d(pt);
      Point3d ptIn = new Point3d(pt);
      ptOut.Transform(mvOut);
      ptIn.Transform(mvIn);
      ptsOut.Add(ptOut);
      ptsIn.Add(ptIn);
    }

    Curve crvOut;
    Curve crvIn;

    if(borderCrv.IsPolyline()) {
      crvOut = new PolylineCurve(ptsOut);
      crvIn = new PolylineCurve(ptsIn);
    }
    else {
      crvOut = Curve.CreateInterpolatedCurve(ptsOut, 3);
      crvIn = Curve.CreateInterpolatedCurve(ptsIn, 3);
    }
    List<Curve> crvs = new List<Curve>();
    crvs.Add(crvOut);
    crvs.Add(crvIn);
    Brep[] lofts = Brep.CreateFromLoft(crvs, Point3d.Unset, Point3d.Unset, LoftType.Normal, false);

    double minSoFar = Double.MaxValue;
    Interval interval = new Interval(0, 1);
    Point3d loftPt = lofts[0].Faces[0].PointAt(0, 0);
    BrepFace testFace = environment.Faces[0];
    Point3d facePt = testFace.PointAt(0.25, 0.25);
    foreach(BrepFace face in environment.Faces) {
      double u, v;
      face.ClosestPoint(loftPt, out u, out v);
      facePt = face.PointAt(u, v);
      dist = loftPt.DistanceTo(facePt);
      if(dist < minSoFar) {
        minSoFar = dist;
        testFace = face;
      }
    }
    AA = testFace.ToBrep();
    AB = testFace.DuplicateFace(false);

    Vector3d loftNrml = lofts[0].Faces[0].NormalAt(0, 0);
    B = loftPt;
    C = loftNrml;
    testFace.SetDomain(0, interval);
    testFace.SetDomain(1, interval);
    facePt = testFace.PointAt(0.5, 0.5);
    Vector3d testVec = Vector3d.Subtract(new Vector3d(facePt), new Vector3d(loftPt));
    D = loftPt;
    E = testVec;
    double dotProd = Vector3d.Multiply(loftNrml, testVec) / (loftNrml.Length * testVec.Length);
    F = dotProd;
    if(dotProd >= 0) {
      foreach(Brep brep in lofts) {
        brep.Flip();
      }
    }
    A = lofts.ToList();
# ---------- end getborderwalls_2 ----------
panel_3 = Panel(getborderwalls.F)
brep_6 = Brep(getborderwalls.A)
deplane = DeconstructPlane(Plane=formingpts)  # -> Origin, XAxis, YAxis, ZAxis
vdis_5 = VectorDisplay(Anchor=getborderwalls.B, Vector=getborderwalls.C)
pt_5 = Point(formingpts)
vdis_6 = VectorDisplay(Anchor=getborderwalls.D, Vector=getborderwalls.E)
contain = ContainForce(Agent=deconstructsystem.Agents, Apply=True, WeightMultiplier=1, Environment=polysrfenv, VisionRadius=1)
# Finds all agents 5 units away
neighbors = GetNeighborsInRadius(
    Agent=deconstructsystem.Agents,
    AgentCollection=deconstructsystem.AgentCollection,
    VisionRadius=agent_cohesion_vision_radius,
    VisionAngle=360)  # disabled
number_slider_3 = Slider(0.48, range=0..1)
amp = Amplitude(Vector=deplane.ZAxis, Amplitude=expr("-x", number_slider_2))
amp_2 = Amplitude(Vector=deplane.ZAxis, Amplitude=number_slider_2)
panel_4 = Panel(getborderwalls_2.F)
brep_7 = Brep(getborderwalls_2.A)
vdis_7 = VectorDisplay(Anchor=getborderwalls_2.B, Vector=getborderwalls_2.C)
vdis_8 = VectorDisplay(Anchor=getborderwalls_2.D, Vector=getborderwalls_2.E)
move = Move(Geometry=divbyangle.P, Motion=amp_2)  # -> Geometry, Transform
move_2 = Move(Geometry=divbyangle.P, Motion=amp)  # -> Geometry, Transform
intcrv = Interpolate(Vertices=move.Geometry, Degree=3, Periodic=False, KnotStyle=1)  # -> Curve, Length, Domain
brep_8 = Brep(getborderwalls_2.AB)
pcen = PolygonCenter(Polyline=brep_8)  # -> CenterV, CenterE, CenterA
srf_3 = Surface(getborderwalls_2.AA)
pline = PolyLine(Vertices=move.Geometry, Closed=True)
pline_2 = PolyLine(Vertices=move_2.Geometry, Closed=True)
pcol = PolylineCollapse(Polyline=pline, Tolerance=number_slider_3)  # -> Polyline, Count
deconstructagent = DeconstructAgent(Agent=deconstructsystem.Agents)  # -> Position, graft(Velocity), Acceleration, Lifespan, ReferencePosition
intcrv_2 = Interpolate(Vertices=move_2.Geometry, Degree=3, Periodic=False, KnotStyle=1)  # -> Curve, Length, Domain
pcol_2 = PolylineCollapse(Polyline=pline_2, Tolerance=number_slider_3)  # -> Polyline, Count
number_slider_4 = Slider(0, range=0..100)
len = Length(Curve=intcrv.Curve)
redpline = Reduce(Polyline=pline, Tolerance=Slider(1, range=0..1))  # -> Polyline, Reduction
# DECONSTRUCT AGENT:
# Exposes the Agents' Position and other fields so you can see them.
pt_6 = Point(deconstructagent.ReferencePosition)
pt_7 = Point(deconstructagent.Position)
item = ListItem(List=pt_7, Index=0, Wrap=True)  # -> flatten(Item)
vdis_9 = VectorDisplay(Anchor=item, Vector=contain)
# Looks at all agents within 5 units away and finds the ones within 5/3 units away - this makes the runtime faster
neighbors_2 = GetNeighborsInRadius(Agent=deconstructsystem.Agents, AgentCollection=neighbors, VisionRadius=division, VisionAngle=360)
merge = Merge(Data1=flatten(pline), Data3=flatten(pline_2))
reb = RebuildCurve(Curve=intcrv.Curve, Count=expr("x/2", len), Tangents=False)
vdis_10 = VectorDisplay(Anchor=pt_7, Vector=deconstructagent.Velocity)
# COHESE AND SEPARATE:
# A takes in agent. This will look at each individual agent in the system.
# AC takes in output from neighbors component to get all of the neighbors within the vision radius.
# W is the strength of the force. Default to 1.
separate = SeparateForce(Agent=deconstructsystem.Agents, Apply=True, WeightMultiplier=1, GetNeighborsInRadius=neighbors_2)
cohese = CoheseForce(Agent=deconstructsystem.Agents, Apply=True, WeightMultiplier=1, GetNeighborsInRadius=neighbors)  # disabled
loft = Loft(Curves=merge, Options={Adjust=False, Closed=False, LoftEnds=0, LoftSimp=1, LoftType=0, Rebuild=10, Refit=0.01})
item_2 = ListItem(List=deconstructagent.Position, Index=0, Wrap=True)
# You can preview the force vectors from each force component by using the vector preview component.
vdis_11 = VectorDisplay(Anchor=flatten(item_2), Vector=separate)

# ==== cluster FormingPts
contactpts = ClusterInput()
orientedgeo = ClusterInput()
formingtoolrad = ClusterInput()
contactpts_2 = Point(contactpts)
orientedgeo_2 = Brep(orientedgeo)
item = ListItem(List=flatten(contactpts_2), Index=0, Wrap=True)
orientedgeo_3 = Brep(orientedgeo_2)
contactpts_3 = Point(contactpts)
offsetbreppts = CSharpScript(contactPts=orientedgeo_3, geo=orientedgeo_3, distance=Slider(0.3, range=0..10))  # -> flatten(out), frames, nrmls, A; inputs contactPts: list of Point3d, geo: Brep, distance: Double
# ---------- offsetbreppts: C# ----------
                                                                                                                                                                                                                                                                                                                                                                                /*
    offsetPlnsFromNormal : LinkedList<Plane> * Brep * double -> List<Vector3d> * List<Plane>
    REQUIRES: true
    ENSURES: offsetPlnsFromNormal(contactPts, geo, distance) returns the pts translated by the
           normal vector at the closest point to the srf with a magnitude of mag
    */

    //Initialize variables
    List<Surface> brepSrfs = new List<Surface>();
    List<Vector3d> normalsOut = new List<Vector3d>();
    List<Plane> framesOut = new List<Plane>();
    List<Plane> framesTemp = new List<Plane>();
    double u,v;
    Vector3d brepNormal;
    Plane frame;
    double epsilon = 0.01; //The minimum distance to determine which surface a pt is touching.

    //Explode brep
    Rhino.Geometry.Collections.BrepFaceList brepFaces = geo.Faces;
    foreach(Rhino.Geometry.BrepFace face in brepFaces) {
      brepSrfs.Add(face.ToBrep().Surfaces[0]);
    }

    /*
    for each point, get the closest point to each surface
    */
    foreach(Point3d pt in contactPts) {
      foreach(Surface srf in brepSrfs) {
        srf.ClosestPoint(pt, out u, out v);
        srf.FrameAt(u, v, out frame);
        if(pt.DistanceTo(frame.Origin) <= epsilon) {
          framesTemp.Add(frame);
        }
      }

      /*
      if there is 1 close surface:
        add the two normal vectors together to get the bisector
      */
      if(framesTemp.Count == 1) {
        brepNormal = framesTemp[0].Normal;
      }
      /*
      if there are 2 equally close surfaces:
        add the two normal vectors together to get the bisector
      */
      else {
        brepNormal = framesTemp[0].Normal;
        foreach(Plane pln in framesTemp) {
          brepNormal = Vector3d.Add(brepNormal, pln.Normal);
        }
      }

      //Set magnitude to distance.
      brepNormal.Unitize();
      brepNormal *= distance;

      //Move the frame by the distance.
      frame = framesTemp[0];
      frame.Translate(brepNormal);
      if(distance < 0) {
        frame.Flip();
        frame.Rotate(-Math.PI / 2, frame.ZAxis);
      }

      //Step
      framesOut.Add(frame);
      normalsOut.Add(brepNormal);

      framesTemp.Clear();
    }

    frames = framesOut;
    nrmls = normalsOut;
# ---------- end offsetbreppts ----------
c_script = CSharpScript(env=orientedgeo_3, pts=contactpts_3, dist=Slider(0.5, range=0..1))  # -> out, A, B, C; inputs env: Brep, pts: list of Point3d, dist: Double
# ---------- c_script: C# ----------
    //Initialize variables
    List<Surface> brepSrfs = new List<Surface>();
    List<Vector3d> normalsOut = new List<Vector3d>();
    List<Plane> framesOut = new List<Plane>();
    List<Plane> framesTemp = new List<Plane>();
    double u,v;
    Vector3d brepNormal;
    Plane frame;
    double epsilon = 0.000001; //The minimum distance to determine which surface a pt is touching.

    //Explode brep
    Rhino.Geometry.Collections.BrepFaceList brepFaces = env.Faces;
    foreach(Rhino.Geometry.BrepFace face in brepFaces) {

      if(!face.NormalAt(0, 0).Equals(face.ToBrep().Surfaces[0].NormalAt(0, 0))) {
        brepSrfs.Add(face.ToBrep().Surfaces[0].Reverse(0, true));
      }
      else {
        brepSrfs.Add(face.ToBrep().Surfaces[0]);
      }
    }



    /*
    for each point, get the closest point to each surface
    */
    foreach(Point3d pt in pts) {
      framesTemp.Clear();
      foreach(Surface srf in brepSrfs) {
        srf.ClosestPoint(pt, out u, out v);
        srf.FrameAt(u, v, out frame);
        if(pt.DistanceTo(frame.Origin) <= epsilon) {
          framesTemp.Add(frame);
        }
      }
      /*
      if there is 1 close surface:
        add the two normal vectors together to get the bisector
      */
      if(framesTemp.Count == 1) {
        brepNormal = framesTemp[0].Normal;
      }
      /*
      if there are 2 equally close surfaces:
        add the two normal vectors together to get the bisector
      */
      else {
        brepNormal = framesTemp[0].Normal;
        foreach(Plane pln in framesTemp) {
          brepNormal = Vector3d.Add(brepNormal, pln.Normal);
        }
      }

      //Set magnitude to distance.
      brepNormal.Unitize();
      brepNormal *= dist;

      normalsOut.Add(brepNormal);
    }
    A = brepSrfs;
    B = normalsOut;
    C = framesTemp;
# ---------- end c_script ----------
pln = Plane(c_script.C)
srf = Surface(c_script.A)
srf_cp = SurfaceClosestPoint(Point=contactpts_3, Surface=graft(srf))  # -> Point, UVPoint, Distance
equals = Equality(FirstNumber=srf_cp.Distance, SecondNumber=0)  # -> Equality, Inequality
cull = CullPattern(List=srf_cp.UVPoint, CullPattern=equals.Equality)
pl = PlaneNormal(Origin=contactpts_3, ZAxis=c_script.B)
evalsrf = EvaluateSurface(Surface=simplify(graft(srf)), Point=simplify(cull))  # -> Point, Normal, Frame
vdis = VectorDisplay(Anchor=pln, Vector=pln)
cull_2 = CullPattern(List=srf_cp.Point, CullPattern=equals.Equality)
formingframes = Plane(simplify(pl))
vdis_2 = VectorDisplay(Anchor=contactpts_3, Vector=c_script.B)
pt = Point(offsetbreppts.frames)
ma = MassAddition(Input=evalsrf.Normal)  # -> Result, PartialResults
vdis_3 = VectorDisplay(Anchor=evalsrf.Point, Vector=evalsrf.Normal)
ma_2 = MassAddition(Input=evalsrf.Point)  # -> Result, PartialResults
formingframes_2 = ClusterOutput(formingframes)
vdis_4 = VectorDisplay(Vector=simplify(ma.Result))
