# Grasshopper definition sharksAndMinnowsDemo.gh (Grasshopper 0.9.75)
# plug-ins: Agent

number_slider = Slider(40, range=0..100)
number_slider_2 = Slider(0.2, range=0..1)
number_slider_3 = Slider(5, range=0..10)
number_slider_4 = Slider(6, range=0..10)
number_slider_5 = Slider(100000, range=0..100000)
box = DomainBox(Base=PlaneXY(0, 0, 0), X=number_slider, Y=number_slider, Z=number_slider)
wires = BrepWireframe(Brep=box, Density=-1)
toggle = BooleanToggle(False)

agent = ConstructAgent(
    Lifespan=number_slider_5,
    Mass=1,
    BodySize=1,
    MaxSpeed=Slider(1.5, range=0..10),
    MaxForce=0.1,
    HistoryLength=Slider(8, range=0..10))
boxemit = BoxEmitter(Box=box, ContinuousFlow=toggle, CreationRate=1, NumberOfAgents=Slider(7, range=0..1000))
system = System(Agents=agent, Emitters=boxemit)

number_slider_6 = Slider(1, range=0..1)

agent_2 = ConstructAgent(
    Lifespan=number_slider_5,
    Mass=1,
    BodySize=1,
    MaxSpeed=Slider(0.75, range=0..1),
    MaxForce=Slider(0.3, range=0..1),
    HistoryLength=Slider(3, range=0..10))
boxemit_2 = BoxEmitter(Box=box, ContinuousFlow=toggle, CreationRate=1, NumberOfAgents=Slider(100, range=0..1000))
system_2 = System(Agents=agent_2, Emitters=boxemit_2)
deconstructsystem = DeconstructSystem(System=system_2)  # -> Agents, AgentCollection
deconstructagent = DeconstructAgent(Agent=deconstructsystem.Agents)  # -> Position, Velocity, Acceleration, Lifespan, PositionHistory

aaboxenv = AxisAlignedBoxEnvironment(Box=box)
number_slider_7 = Slider(10, range=0..10)
multiplication = Multiplication(A=number_slider_3, B=Slider(0.54, range=0..1))
multiplication_2 = Multiplication(A=number_slider_3, B=Slider(0.2, range=0..1))
timer = Timer(TimerInterval=1, Target=[engine, system_2, system])
deconstructsystem_2 = DeconstructSystem(System=system)  # -> Agents, AgentCollection
multiplication_3 = Multiplication(A=number_slider_3, B=Slider(0.5, range=0..1))
engine = Engine(Reset=Toggle(True), System=[system_2, system])

# ---- group: Interactions
neighbors = GetNeighborsInRadius(
    Agent=deconstructsystem.Agents,
    AgentCollection=deconstructsystem_2.AgentCollection,
    VisionRadius=multiplication_3,
    VisionAngle=Slider(90, range=0..100))
neighbors_2 = GetNeighborsInRadius(
    Agent=deconstructsystem_2.Agents,
    AgentCollection=deconstructsystem.AgentCollection,
    VisionRadius=number_slider_7,
    VisionAngle=360)
neighbors_3 = GetNeighborsInRadius(
    Agent=deconstructsystem_2.Agents,
    AgentCollection=neighbors_2,
    VisionRadius=Slider(1, range=0..1),
    VisionAngle=Slider(30, range=0..100))
separate = SeparateForce(Agent=deconstructsystem.Agents, GetNeighborsInRadius=neighbors, WeightMultiplier=number_slider_6)
cohese = CoheseForce(Agent=deconstructsystem_2.Agents, GetNeighborsInRadius=neighbors_2, WeightMultiplier=Slider(1, range=0..1))
eat = EatBehavior(Agent=deconstructsystem_2.Agents, GetNeighborsInRadius=neighbors_3)

# ---- group: Minnows Forces
neighbors_4 = GetNeighborsInRadius(
    Agent=deconstructsystem.Agents,
    AgentCollection=deconstructsystem.AgentCollection,
    VisionRadius=number_slider_3,
    VisionAngle=Slider(180, range=0..1000))
neighbors_5 = GetNeighborsInRadius(Agent=deconstructsystem.Agents, AgentCollection=neighbors_4, VisionRadius=multiplication, VisionAngle=360)
neighbors_6 = GetNeighborsInRadius(Agent=deconstructsystem.Agents, AgentCollection=neighbors_5, VisionRadius=multiplication_2, VisionAngle=360)
align = AlignForce(Agent=deconstructsystem.Agents, GetNeighborsInRadius=neighbors_5, WeightMultiplier=Slider(0.221, range=0..1))
separate_2 = SeparateForce(Agent=deconstructsystem.Agents, GetNeighborsInRadius=neighbors_6, WeightMultiplier=number_slider_6)
cohese_2 = CoheseForce(Agent=deconstructsystem.Agents, GetNeighborsInRadius=neighbors_4, WeightMultiplier=Slider(0.125, range=0..1))
contain = ContainForce(Agent=deconstructsystem.Agents, Environment=aaboxenv, WeightMultiplier=number_slider_2, VisionRadius=number_slider_4)

# ----
multiplication_4 = Multiplication(A=number_slider_7, B=Slider(0.5, range=0..1))
deconstructagent_2 = DeconstructAgent(Agent=deconstructsystem_2.Agents)  # -> Position, Velocity, Acceleration, Lifespan, PositionHistory

# ---- group: Sharks Forces
neighbors_7 = GetNeighborsInRadius(
    Agent=deconstructsystem_2.Agents,
    AgentCollection=deconstructsystem_2.AgentCollection,
    VisionRadius=multiplication_4,
    VisionAngle=360)
contain_2 = ContainForce(Agent=deconstructsystem_2.Agents, Environment=aaboxenv, WeightMultiplier=number_slider_2, VisionRadius=number_slider_4)
separate_3 = SeparateForce(Agent=deconstructsystem_2.Agents, GetNeighborsInRadius=neighbors_7, WeightMultiplier=1)

# ----
intcrv = Interpolate(Vertices=deconstructagent_2.PositionHistory, Degree=3, Periodic=False, KnotStyle=1)  # -> Curve, Length, Domain
intcrv_2 = Interpolate(Vertices=deconstructagent.PositionHistory, Degree=3, Periodic=False, KnotStyle=1)  # -> Curve, Length, Domain
dispatch = Dispatch(List=flatten(intcrv.Curve), DispatchPattern=eat)  # -> ListA, ListB
number_slider_8 = Slider(3, range=0..10)
swatch = ColourSwatch(SwatchColor=RGB(255, 0, 131))
swatch_2 = ColourSwatch(SwatchColor=RGB(255, 255, 255))
swatch_3 = ColourSwatch(SwatchColor=RGB(128, 255, 255))
preview = CustomPreview(Geometry=dispatch.ListB, Shader=swatch)
vdisex = VectorDisplayEx(Point=deconstructagent_2.Position, Vector=deconstructagent_2.Velocity, Colour=swatch, Width=number_slider_8)
vdisex_2 = VectorDisplayEx(Point=dispatch.ListA, Vector=deconstructagent_2.Velocity, Colour=swatch_2, Width=number_slider_8)
preview_2 = CustomPreview(Geometry=dispatch.ListA, Shader=swatch_2)
vdisex_3 = VectorDisplayEx(Point=deconstructagent.Position, Vector=deconstructagent.Velocity, Colour=swatch_3, Width=1)
preview_3 = CustomPreview(Geometry=intcrv_2.Curve, Shader=swatch_3)
