# Grasshopper definition surfaceEnvironmentTest.gh (Grasshopper 0.9.75)
# plug-ins: Agent

number_slider = Slider(0.1, range=0..1)
number_slider_2 = Slider(1, range=0..10)
number_slider_3 = Slider(10, range=0..10)
vec = VectorXYZ(XComponent=expr("-x", number_slider), YComponent=expr("-x", number_slider), ZComponent=expr("-x", 0))  # -> Vector, Length
vec_2 = VectorXYZ(XComponent=number_slider, YComponent=number_slider, ZComponent=0)  # -> Vector, Length
crv = Curve([<curve referenced from the Rhino model> x2])
particle = ConstructParticle(
    MinimumInitialVelocity=vec.Vector,
    MaximumInitialVelocity=vec_2.Vector,
    Acceleration=Vector(0, 0, 0),
    Lifespan=Slider(96, range=-1..1000),
    Mass=1,
    BodySize=1,
    HistoryLength=1)
pt = Point(<point referenced from the Rhino model>)
loft = Loft(Curves=crv, Options={Adjust=False, Closed=False, LoftEnds=0, LoftSimp=0, LoftType=0, Rebuild=10, Refit=0.01})
ptemit = PointEmitter(ContinuousFlow=Toggle(True), CreationRate=1, NumberOfQuelea=0, Point=pt)
agent = ConstructAgent(Particle=particle, MaxSpeed=Slider(0.1, range=0..1), MaxForce=0.1, VisionRadius=5, VisionAngle=360)
srfenv = SurfaceEnvironment(Surface=loft)  # -> Environment, _2DReferenceSurface
timer = Timer(TimerInterval=20, Target=[engine, system])  # disabled
system = System(Quelea=agent, Emitters=ptemit, Environment=srfenv.Environment)
pt_2 = Point(<point referenced from the Rhino model>)
desystem = DeconstructSystem(System=system)  # -> Quelea, QueleaNetwork
engine = Engine(Reset=Toggle(True), System=system)
departicle = DeconstructParticle(Particle=desystem.Quelea)  # -> Position, Velocity, Acceleration, Lifespan, Mass, BodySize, SurfacePosition, SurfaceVelocity, SurfaceAcceleration
seek = SeekForce(Apply=True, Agent=desystem.Quelea, WeightMultiplier=Slider(0.1, range=0..1), TargetPoint=pt_2)
item = ListItem(List=departicle.Position, Index=0, Wrap=True)  # -> flatten(Item)
pt_3 = Point(departicle.SurfacePosition)
vdis = VectorDisplay(Anchor=pt_3, Vector=departicle.SurfaceVelocity)
vdis_2 = VectorDisplay(Anchor=item, Vector=departicle.Velocity)
vlen = VectorLength(Vector=departicle.Velocity)
preview = CustomPreview(Geometry=item, Shader=ColourSwatch(SwatchColor=RGB(255, 255, 255)))
panel = Panel(vlen)
