# Grasshopper definition test.gh (Grasshopper 0.9.75)
# plug-ins: Agent

number_slider = Slider(1, range=0..1)
crv = Curve([<curve referenced from the Rhino model> x2])
pt = Point(<point referenced from the Rhino model>)
pt_2 = Point(<point referenced from the Rhino model>)
loft = Loft(Curves=crv, Options={Adjust=False, Closed=False, LoftEnds=0, LoftSimp=0, LoftType=0, Rebuild=10, Refit=0.01})
toggle = BooleanToggle(False)
preview = CustomPreview(Geometry=pt, Shader=ColourSwatch(SwatchColor=RGB(0, 255, 255)))
box = DomainBox(Base=pt_2, X=Slider(10, range=0..10), Y=Slider(10, range=0..10), Z=Slider(10, range=0..10))
srf = Surface(loft)
dedom2num = DeconstructDomain²(Domain=srf)  # -> UMin, UMax, VMin, VMax
pemit = PointEmitter(Point=pt, ContinuousFlow=True, CreationRate=1, NumberOfAgents=0)
agent = Agent(
    Lifespan=Slider(61, range=0..1000),
    Mass=1,
    BodySize=1,
    MaximumSpeed=0.5,
    MaximumForce=0.1,
    VisionAngle=15,
    VisionRadius=5,
    LengthOfPositionHistory=1)
wboxenv = WorldBoxEnvironment(Box=box)
srfenv = SurfaceEnvironment(Surface=srf)
planesrf = PlaneSurface(Plane=PlaneXY(0, 0, 0), XSize=dedom2num.UMax, YSize=dedom2num.VMax)
swatch = ColourSwatch(SwatchColor=RGBA(0, 72, 0, 155))
system = AgentSystem(Agents=agent, Emitters=pemit, Environment=wboxenv)
timer = Timer(TimerInterval=20, Target=engine)  # disabled
preview_2 = CustomPreview(Geometry=box, Shader=swatch)
preview_3 = CustomPreview(Geometry=srf, Shader=swatch)
engine = Engine(Reset=Toggle(False), LiveUpdate=Toggle(True), Systems=system)
debugdeconstructagent = DebugDeconstructAgent(Agent=engine)  # -> Position, Velocity, Acceleration, Lifespan, RefPosition
deconstructagent = DeconstructAgent(Agent=engine)  # -> Position, Velocity, Acceleration, Lifespan
pt_3 = Point(debugdeconstructagent.Position)
panel = Panel(deconstructagent.Position)
pt_4 = Point(debugdeconstructagent.RefPosition)
preview_4 = CustomPreview(Geometry=pt_3, Shader=ColourSwatch(SwatchColor=RGB(0, 255, 0)))
preview_5 = CustomPreview(Geometry=pt_4, Shader=ColourSwatch(SwatchColor=RGBA(255, 255, 0, 153)))
panel_2 = Panel(pt_3)
