# Grasshopper definition test4.gh (Grasshopper 0.9.75)
# plug-ins: Agent

number_slider = Slider(100, range=0..100)
dom = ConstructDomain(DomainStart=expr("-x", number_slider), DomainEnd=number_slider)
box = DomainBox(Base=PlaneXY(0, 0, 0), X=Domain(-2, 2), Y=Domain(-0.5, 0.5), Z=Domain(0, 0.25))
box_2 = DomainBox(Base=PlaneXY(0, 0, 0), X=dom, Y=dom, Z=dom)
boxemit = BoxEmitter(Box=box_2, ContinuousFlow=Toggle(False), CreationRate=1, NumberOfAgents=Slider(1000, range=0..1000))
agent = Agent(
    Lifespan=Slider(1000, range=0..1000),
    Mass=1,
    BodySize=1,
    MaximumSpeed=0.5,
    MaximumForce=0.1,
    VisionAngle=15,
    VisionRadius=5,
    LengthOfPositionHistory=1)
cohese = CoheseForce(Weight=1, VisionMultiplier=1)
system = AgentSystem(Agents=agent, Emitters=boxemit, Forces=cohese)
systemaslist = AgentSystemList(Agents=agent, Emitters=boxemit, Forces=cohese)
timer = Timer(TimerInterval=20, Target=engine)
engine = Engine(Reset=Toggle(True), Systems=system)
deconstructagent = DeconstructAgent(Agent=engine)  # -> Position, Velocity, Acceleration, Lifespan
