# Grasshopper definition wanderTest_20150326.gh (Grasshopper 0.9.75)
# plug-ins: Agent

number_slider = Slider(5, range=0..10)
number_slider_2 = Slider(100, range=0..100)
number_slider_3 = Slider(15, range=0..100)
number_slider_4 = Slider(1, range=0..1)
particle = ConstructParticle(
    MinimumInitialVelocity=Vector(-0.1, -0.1, -0.1),
    MaximumInitialVelocity=Vector(0.1, 0.1, 0.1),
    Acceleration=Vector(0, 0, 0),
    Lifespan=Slider(-1, range=-1..1000),
    Mass=1,
    BodySize=1,
    HistoryLength=Slider(1000, range=0..1000))
box = CenterBox(Base=PlaneXY(0, 0, 0), X=number_slider_3, Y=number_slider_3, Z=number_slider_3)
ptemit = PointEmitter(ContinuousFlow=True, CreationRate=1, NumberOfQuelea=Slider(2, range=0..10), Point=Point(0, 0, 0))
boxemit = BoxEmitter(ContinuousFlow=True, CreationRate=1, NumberOfQuelea=0, Box=box)
agent = ConstructAgent(Particle=particle, MaxSpeed=Slider(0.5, range=0..1), MaxForce=0.1, VisionRadius=5, VisionAngle=360)
system = System(Quelea=agent, Emitters=ptemit)
timer = Timer(TimerInterval=20, Target=[engine, system])  # disabled
desystem = DeconstructSystem(System=system)  # -> Quelea, QueleaNetwork
merge = Merge(Data1=Slider(1, range=0..1), Data2=Slider(15, range=0..100))
merge_2 = Merge(Data1=Slider(0.14, range=0..1), Data2=Slider(1, range=0..1))
engine = Engine(Reset=Toggle(True), System=system)
dequelea = DeconstructQuelea(Quelea=desystem.Quelea)  # -> Position, Velocity, Acceleration, Lifespan, ReferencePosition
wander = WanderForce(Apply=True, Agent=desystem.Quelea, WeightMultiplier=1, Strength=merge, Rate=merge_2)  # -> Force, Sphere, TargetPoint
intcrv = Interpolate(Vertices=dequelea.Position, Degree=3, Periodic=False, KnotStyle=1)  # -> flatten(Curve), Length, Domain
item = ListItem(List=intcrv.Curve, Index=0, Wrap=True)
