# Grasshopper definition wrap.gh (Grasshopper 0.9.76)
# plug-ins: Agent

number_slider = Slider(8, range=0..100)
pt = ConstructPoint(XCoordinate=0, YCoordinate=0, ZCoordinate=0)
# Follow along with the video tutorial:
# https://www.youtube.com/watch?v=_OaPhpslNHw
construct_particle = ConstructParticle(
    UpDirection=Vector(0, 0, 1),
    Acceleration=Vector(0, 0, 0),
    Lifespan=Slider(-1, range=-1..1000),
    Mass=1,
    BodySize=1,
    HistoryLength=Slider(100, range=0..100))
line = LineSDL(Start=pt, Direction=Vector(0, 0, 1), Length=Slider(15, range=0..100))
box = CenterBox(Base=PlaneXY(0, 0, 0), X=number_slider, Y=number_slider, Z=number_slider)
pipe = Pipe(Curve=line, Radius=1, Caps=0)
number_slider_2 = Slider(100, range=0..1000)
boolean_toggle = BooleanToggle(False)
boxemit = BoxEmitter(
    ContinuousFlow=boolean_toggle,
    CreationRate=1,
    NumberOfQuelea=number_slider_2,
    MinimumInitialVelocity=Vector(-0.1, -0.1, -0.1),
    MaximumInitialVelocity=Vector(0.1, 0.1, 0.1),
    Box=box)
planesrf = PlaneSurface(Plane=PlaneXY(0, 0, 0), XSize=Domain(-10, 10), YSize=Domain(-10, 10))
construct_agent = ConstructAgent(
    ParticleQueleaSettings=construct_particle,
    MaxSpeed=Slider(0.3, range=0..10),
    MaxForce=Slider(0.01, range=0..1),
    VisionRadius=Slider(5, range=0..10),
    VisionAngle=360)
toggle = BooleanToggle(True)
aaboxenv = AxisAlignedBoxEnvironment(Box=box, Wrap=toggle)
srfemit = SurfaceEmitter(
    ContinuousFlow=boolean_toggle,
    CreationRate=1,
    NumberOfQuelea=number_slider_2,
    MinimumInitialVelocity=Vector(-0.1, -0.1, -0.1),
    MaximumInitialVelocity=Vector(0.1, 0.1, 0.1),
    Surface=pipe)
srfenv = SurfaceEnvironment(Surface=pipe, Wrap=toggle)  # -> Environment, _2DReferenceSurface
system = System(QueleaSettings=construct_agent, Emitters=srfemit, Environment=srfenv.Environment)  # -> System, Quelea, QueleaNetwork
quelea = Data(system.Quelea)
number_slider_3 = Slider(0.667, range=0..1)
timer = Timer(TimerInterval=20, Target=[engine, system])  # disabled
engine = Engine(Reset=Toggle(False), System=system.System)
get_neighbors_in_radius = GetNeighborsInRadius(
    AgentQuelea=quelea,
    QueleaNetwork=system.QueleaNetwork,
    VisionRadiusMultiplier=Slider(1, range=0..1),
    VisionAngleMultiplier=1)
get_neighbors_in_radius_2 = GetNeighborsInRadius(
    AgentQuelea=quelea,
    QueleaNetwork=get_neighbors_in_radius,
    VisionRadiusMultiplier=Slider(0.333, range=0..1),
    VisionAngleMultiplier=1)
get_neighbors_in_radius_3 = GetNeighborsInRadius(
    AgentQuelea=quelea,
    QueleaNetwork=get_neighbors_in_radius_2,
    VisionRadiusMultiplier=number_slider_3,
    VisionAngleMultiplier=1)
get_neighbors_in_radius_4 = GetNeighborsInRadius(
    AgentQuelea=quelea,
    QueleaNetwork=get_neighbors_in_radius_3,
    VisionRadiusMultiplier=number_slider_3,
    VisionAngleMultiplier=Slider(0.125, range=0..1))
deconstruct_particle = DeconstructParticle(ParticleQuelea=system.Quelea)  # -> Position, Velocity, Acceleration, Lifespan, SurfacePosition, SurfaceVelocity, SurfaceAcceleration
pt_2 = Point(deconstruct_particle.Position)
item = ListItem(List=get_neighbors_in_radius, Index=0, Wrap=True)
deconstructqn = DeconstructQueleaNetwork(QueleaNetwork=item)
getposition = GetParticlePosition(ParticleQuelea=deconstructqn)  # -> Position, SurfacePosition
list_item = ListItem(List=deconstruct_particle.Position, Index=0, Wrap=True)  # -> flatten(Item)
pline = PolyLine(Vertices=deconstruct_particle.Position, Closed=False)
quelea_2 = Data(system.Quelea)
pt_3 = Point(getposition.Position)
vector_display = VectorDisplay(Anchor=list_item, Vector=deconstruct_particle.Velocity)
item_2 = ListItem(List=list_item, Index=0, Wrap=True)
contain_force = ContainForce(Apply=True, WeightMultiplier=1, AgentQuelea=quelea_2, VisionRadiusMutliplier=0.2)  # -> Force, DesiredVelocity; disabled
cohese_force = CoheseForce(Apply=True, WeightMultiplier=1, AgentQuelea=quelea_2, QueleaNetwork=get_neighbors_in_radius)  # -> Force, DesiredVelocity
separate_force = SeparateForce(Apply=True, WeightMultiplier=1, AgentQuelea=quelea_2, QueleaNetwork=get_neighbors_in_radius_2)  # -> Force, DesiredVelocity
align_force = AlignForce(Apply=True, WeightMultiplier=Slider(0.25, range=0..1), AgentQuelea=quelea_2, QueleaNetwork=get_neighbors_in_radius_3)  # -> Force, DesiredVelocity
view_force = ViewForce(Apply=True, WeightMultiplier=1, AgentQuelea=quelea_2, QueleaNetwork=get_neighbors_in_radius_4)  # -> Force, DesiredVelocity
preview = CustomPreview(
    Geometry=item_2,
    Shader={ambient=RGB(0, 0, 0), diffuse=RGB(255, 105, 180), emission=RGB(76, 32, 54), shine=0.5, specular=RGB(255, 255, 255), transparency=0})
